# Grasshopper definition Units.gh (Grasshopper 1.0.7)
# plug-ins: FemDesign.Grasshopper, Pufferfish, Human, Weaverbird

resultstype = ResultsResultsType({"NodalDisplacement", "PointSupportReaction", "BarDisplacement", "BarInternalForce", "BarStress", "LineSupportReaction", "ShellDisplacement", "ShellInternalForce", "ShellStress", "NodalVibrationShape", "EigenFrequencies"}, selected=["NodalDisplacement", "PointSupportReaction", "BarDisplacement", "BarInternalForce", "BarStress", "LineSupportReaction", "ShellDisplacement", "ShellInternalForce", "ShellStress", "NodalVibrationShape", "EigenFrequencies"])
units = Units(Length="m", Angle="rad", SectionalData="m", Force="kN", Mass="kg", Displacement="m", Stress="Pa")
path = FilePath("C:\Users\MarcoPellegrinoKonsu\OneDrive - StruSoft AB\FemDesign_API_Development\375-units\StructureTest_out.str")
readstr = ModelReadStr(StrPath=path, ResultTypes=resultstype, Units=units)  # -> FdModel, FdFeaModel, Results
viewer = ParamViewer(readstr.Results)
bang = ExplodeTree()  # -> Branch0, Branch1, Branch2, Branch3, Branch4, Branch5, Branch6, Branch7, Branch8, Branch9
data = Data(bang.Branch9)
data_2 = Data(readstr.FdFeaModel)
data_3 = Data(bang.Branch8)
entwine = Entwine(Branch00=bang.Branch6, Branch01=bang.Branch6, FlattenInputs=True)
panel = Panel("""IL
WIND""")
panel_2 = Panel("""IL
WIND""")
graft = GraftTree(Tree=panel, IncludeEmptyLists=True, IncludeNullItems=True)
shell_forces = ResultsShellForce(Result=simplify(entwine), CaseCombinationName=panel)  # -> CaseIdentifier, ElementId, NodeId, Mx, My, Mxy, Nx, Ny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
pointsupportreaction = ResultsPointSupportReaction(Result=bang.Branch1, CaseCombinationName="IL")  # -> CaseIdentifier, Identifier, NodeId, SupportPosition, ReactionForce, ReactionMoment, ForceResultant, MomentResultant
bardisplacement = ResultsBarDisplacement(Result=bang.Branch2, CaseCombinationName="IL")  # -> CaseIdentifier, ElementId, PositionResult, Translation, Rotation
barstress = ResultsBarStress(Result=bang.Branch4, CaseCombinationName="IL")  # -> CaseIdentifier, ElementId, PositionResult, SigmaXiMax, SigmaXiMin, SigmaVM
nodaldisplacement = ResultsNodalDisplacement(Result=bang.Branch0, CaseCombinationName=panel_2)  # -> CaseIdentifier, NodeId, Translation, Rotation
shelldisplacement = ResultsShellDisplacement(Result=bang.Branch5, CaseCombinationName="IL")  # -> CaseIdentifier, ElementId, NodeId, Translation, Rotation
barinternalforce = ResultsBarInternalForce(Result=bang.Branch3, CaseCombinationName="IL")  # -> CaseIdentifier, ElementId, PositionResult, Fx, Fy, Fz, Mx, My, Mz
feashell = ResultsFeaShell(FdFeaModel=readstr.FdFeaModel)  # -> Identifier, ElementId, FaceIndex, MeshGeometry
feabar = ResultsFeaBar(FdFeaModel=readstr.FdFeaModel)  # -> Identifier, ElementId, NodeI, NodeJ, LineGeometry
feanode = ResultsFeaNode(FdfeaModel=readstr.FdFeaModel)  # -> NodeId, Point
feashell_2 = ResultsFeaShell(FdFeaModel=readstr.FdFeaModel)  # -> Identifier, ElementId, FaceIndex, MeshGeometry
feabar_2 = ResultsFeaBar(FdFeaModel=readstr.FdFeaModel)  # -> Identifier, ElementId, NodeI, NodeJ, LineGeometry
shellstress = ResultsShellStress(Result=bang.Branch7, CaseCombinationName="IL", Side="top")  # -> CaseIdentifier, ElementId, NodeId, SigmaX, SigmaY, TauXY, TauXZ, TauYZ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
feabar_3 = ResultsFeaBar(FdFeaModel=readstr.FdFeaModel)  # -> Identifier, ElementId, NodeI, NodeJ, LineGeometry
nodalvibration = ResultsNodalVibration(Result=bang.Branch8, VibrationMode=Slider(7, range=1..12))  # -> ShapeId, Identifier, NodeId, Translation, Rotation
feanode_2 = ResultsFeaNode(FdfeaModel=readstr.FdFeaModel)  # -> NodeId, Point
eigenfrequencies = ResultsEigenFrequencies(Result=bang.Branch9)  # -> ShapeId, Frequency, Period, ModalMass, MassParticipantXi, MassParticipantYi, MassParticipantZi
feabar_4 = ResultsFeaBar(FdFeaModel=data_2)  # -> Identifier, ElementId, NodeI, NodeJ, LineGeometry
nodalvibration_2 = ResultsNodalVibration(Result=data_3, VibrationMode=Slider(7, range=1..12))  # -> ShapeId, Identifier, NodeId, Translation, Rotation
feanode_3 = ResultsFeaNode()  # -> NodeId, Point
feanode_4 = ResultsFeaNode(FdfeaModel=data_2)  # -> NodeId, Point
eigenfrequencies_2 = ResultsEigenFrequencies(Result=data)  # -> ShapeId, Frequency, Period, ModalMass, MassParticipantXi, MassParticipantYi, MassParticipantZi
path_mapper = PathMapper()
wbedges = WeaverbirdsMeshEdges(MeshOrPolylines=feashell_2.MeshGeometry)
split = SplitTree(Data=shell_forces.My, Masks=flatten("{0;*}"))  # -> Positive, Negative
cull_i = CullIndex(List=shell_forces.My, Indices="-1", Wrap=True)
vec = Vector(nodaldisplacement.Translation)
hz = Panel(eigenfrequencies_2.Frequency)
keysearch = KeyValueSearch(Keys=feanode.NodeId, Values=feanode.Point, Search=nodaldisplacement.NodeId)
previewlw = CustomPreviewLineweights(Geometry=[wbedges, feabar_2.LineGeometry], Shader=ColourSwatch(SwatchColor=RGB(163, 163, 163)), Absolute=False)
vec_2 = VectorXYZ(
    XComponent=eigenfrequencies_2.MassParticipantXi,
    YComponent=eigenfrequencies_2.MassParticipantYi,
    ZComponent=eigenfrequencies_2.MassParticipantZi)  # -> Vector, Length
panel_3 = Panel(split.Positive)
avr = Average(Input=cull_i)  # -> flatten(ArithmeticMean)
mass_participant = Panel(vec_2.Vector)

num = Number(avr)
bnd = Bounds(Numbers=num)
maxdisplacement = Number(bnd)
num_2 = Number(num)
dom = ConstructDomain(DomainStart=Slider(0.01, range=0.01..0.5), DomainEnd=Slider(0.05, range=0.01..0.5))
clr = ColorsAlpaca4d(gradIndex=Slider(2, range=0..12))  # -> colors; inputs gradIndex: Int32
#   port colors: A series of colors to be plugged into the "Ladybug_Legend Parameters" component.
# ---------- clr: Python ----------
"""
Preset of gradient colors perfect for Data Visualisation
    Inputs:
        gradIndex: An index refering to one of the following possible gradients:
            0 - Orignal Ladybug
            1 - Nuanced Ladybug
            2 - Multi-colored Ladybug
            3 - Ecotect
            4 - Thermal Comfort Percentage
            5 - Thermal Comfort Colors
            6 - Shade Benefit/Harm
            7 - Shade Harm
            8 - Shade Benefit
            9 - CFD Colors 1
            10 - Radiation Benefit
            11 - Gsa10 Colour
            12 - Gsa9 Colour
    Returns:
        customColors: A series of colors.
"""

ghenv.Component.Name = "Colors (Alpaca4d)"
ghenv.Component.NickName = 'CLR'
ghenv.Component.Message = 'Colors (Alpaca4d)'

import scriptcontext as sc
import Grasshopper.Kernel as gh
import System

gradientLibrary = {
        0: [System.Drawing.Color.FromArgb(75, 107, 169), System.Drawing.Color.FromArgb(115, 147, 202), System.Drawing.Color.FromArgb(170, 200, 247), System.Drawing.Color.FromArgb(193, 213, 208), System.Drawing.Color.FromArgb(245, 239, 103), System.Drawing.Color.FromArgb(252, 230, 74), System.Drawing.Color.FromArgb(239, 156, 21), System.Drawing.Color.FromArgb(234, 123, 0), System.Drawing.Color.FromArgb(234, 74, 0), System.Drawing.Color.FromArgb(234, 38, 0)],
        1: [System.Drawing.Color.FromArgb(49,54,149), System.Drawing.Color.FromArgb(69,117,180), System.Drawing.Color.FromArgb(116,173,209), System.Drawing.Color.FromArgb(171,217,233), System.Drawing.Color.FromArgb(224,243,248), System.Drawing.Color.FromArgb(255,255,191), System.Drawing.Color.FromArgb(254,224,144), System.Drawing.Color.FromArgb(253,174,97), System.Drawing.Color.FromArgb(244,109,67), System.Drawing.Color.FromArgb(215,48,39), System.Drawing.Color.FromArgb(165,0,38)],
        2: [System.Drawing.Color.FromArgb(4,25,145), System.Drawing.Color.FromArgb(7,48,224), System.Drawing.Color.FromArgb(7,88,255), System.Drawing.Color.FromArgb(1,232,255), System.Drawing.Color.FromArgb(97,246,156), System.Drawing.Color.FromArgb(166,249,86), System.Drawing.Color.FromArgb(254,244,1), System.Drawing.Color.FromArgb(255,121,0), System.Drawing.Color.FromArgb(239,39,0), System.Drawing.Color.FromArgb(138,17,0)],
        3: [System.Drawing.Color.FromArgb(0,0,255), System.Drawing.Color.FromArgb(53,0,202), System.Drawing.Color.FromArgb(107,0,148), System.Drawing.Color.FromArgb(160,0,95), System.Drawing.Color.FromArgb(214,0,41), System.Drawing.Color.FromArgb(255,12,0), System.Drawing.Color.FromArgb(255,66,0), System.Drawing.Color.FromArgb(255,119,0), System.Drawing.Color.FromArgb(255,173,0), System.Drawing.Color.FromArgb(255,226,0), System.Drawing.Color.FromArgb(255,255,0)],
        4: [System.Drawing.Color.FromArgb(0,0,0), System.Drawing.Color.FromArgb(110,0,153), System.Drawing.Color.FromArgb(255,0,0), System.Drawing.Color.FromArgb(255,255,102), System.Drawing.Color.FromArgb(255,255,255)],
        5: [System.Drawing.Color.FromArgb(0,136,255), System.Drawing.Color.FromArgb(200,225,255), System.Drawing.Color.FromArgb(255,255,255), System.Drawing.Color.FromArgb(255,230,230), System.Drawing.Color.FromArgb(255,0,0)],
        6: [System.Drawing.Color.FromArgb(5,48,97), System.Drawing.Color.FromArgb(33,102,172), System.Drawing.Color.FromArgb(67,147,195), System.Drawing.Color.FromArgb(146,197,222), System.Drawing.Color.FromArgb(209,229,240), System.Drawing.Color.FromArgb(255,255,255), System.Drawing.Color.FromArgb(253,219,199), System.Drawing.Color.FromArgb(244,165,130), System.Drawing.Color.FromArgb(214,96,77), System.Drawing.Color.FromArgb(178,24,43), System.Drawing.Color.FromArgb(103,0,31)],
        7: [System.Drawing.Color.FromArgb(255,255,255), System.Drawing.Color.FromArgb(253,219,199), System.Drawing.Color.FromArgb(244,165,130), System.Drawing.Color.FromArgb(214,96,77), System.Drawing.Color.FromArgb(178,24,43), System.Drawing.Color.FromArgb(103,0,31)],
        8: [System.Drawing.Color.FromArgb(255,255,255), System.Drawing.Color.FromArgb(209,229,240), System.Drawing.Color.FromArgb(146,197,222), System.Drawing.Color.FromArgb(67,147,195), System.Drawing.Color.FromArgb(33,102,172), System.Drawing.Color.FromArgb(5,48,97)],
        9: [System.Drawing.Color.FromArgb(0,16,120), System.Drawing.Color.FromArgb(38,70,160), System.Drawing.Color.FromArgb(5,180,222), System.Drawing.Color.FromArgb(16,180,109), System.Drawing.Color.FromArgb(59,183,35), System.Drawing.Color.FromArgb(143,209,19), System.Drawing.Color.FromArgb(228,215,29), System.Drawing.Color.FromArgb(246,147,17), System.Drawing.Color.FromArgb(243,74,0), System.Drawing.Color.FromArgb(255,0,0)],
        10: [System.Drawing.Color.FromArgb(0,191,48), System.Drawing.Color.FromArgb(255,238,184), System.Drawing.Color.FromArgb(255,0,0)],
        11: [System.Drawing.Color.FromArgb(204,0,71), System.Drawing.Color.FromArgb(255,182,71), System.Drawing.Color.FromArgb(206,255,115), System.Drawing.Color.FromArgb(26,180, 214),System.Drawing.Color.FromArgb(0,0,207)],
        12: [System.Drawing.Color.FromArgb(255, 51, 51), System.Drawing.Color.FromArgb(255, 170, 51), System.Drawing.Color.FromArgb(255, 255, 51), System.Drawing.Color.FromArgb(170, 255, 125), System.Drawing.Color.FromArgb(51, 255, 231), System.Drawing.Color.FromArgb(51, 170, 255), System.Drawing.Color.FromArgb(51,51, 255)]}
colors = gradientLibrary[gradIndex]
# ---------- end clr ----------
remap = RemapNumbers(Value=num, Source=bnd, Target=Domain(0, 1))  # -> Mapped, Clipped
remap_2 = RemapNumbers(Value=num_2, Source=bnd, Target=dom)  # -> Mapped, Clipped
twnthrucols = TweenThroughColors(
    Colors=clr,
    Factor=remap.Mapped,
    Normalized=True,
    Equalized=False,
    Weighted=False,
    Loopback=False,
    Degree=3,
    InterpolationType=0,
    Alpha=True)
legend = Legend(Colour=clr, Tags=["One Fish", "Two Fish", "Red Fish", "Blue Fish"], LegendType=1)
dots = DotDisplay(Colour=twnthrucols, Size=remap_2.Mapped)

nodeid_j = Data(feabar_3.NodeJ)
pt = Point(feanode_2.Point)
nodeid_i = Data(feabar_3.NodeI)
nodeid = Data(nodalvibration.NodeId)
vector = Data(nodalvibration.Translation)
scale_factor = Slider(5, range=-2..5)
keysearch_2 = KeyValueSearch(Keys=nodeid, Values=vector, Search=nodeid_j)
keysearch_3 = KeyValueSearch(Keys=nodeid, Values=vector, Search=nodeid_i)
subtraction = Subtraction(A=nodeid_i, B=1)
subtraction_2 = Subtraction(A=nodeid_j, B=1)
item = ListItem(List=pt, Index=subtraction, Wrap=True)
item_2 = ListItem(List=pt, Index=subtraction_2, Wrap=True)
multiplication = Multiplication(A=keysearch_2, B=scale_factor)
multiplication_2 = Multiplication(A=keysearch_3, B=scale_factor)
move = Move(Geometry=item, Motion=multiplication_2)  # -> Geometry, Transform
move_2 = Move(Geometry=item_2, Motion=multiplication)  # -> Geometry, Transform
ln = Line(StartPoint=move.Geometry, EndPoint=move_2.Geometry)  # -> flatten(Line)
previewlw_2 = CustomPreviewLineweights(Geometry=ln, Shader=ColourSwatch(SwatchColor=RGB(0, 0, 0)), Thickness="2", Absolute=False)

wbfacepolys = WeaverbirdsFacePolylines(Mesh=feashell.MeshGeometry)
update_ms = Slider(1, range=1..1000)
amplitude = Slider(1, range=1..10)
keysearch_4 = KeyValueSearch(Keys=feanode_2.NodeId, Values=feanode_2.Point, Search=nodalvibration.NodeId)
multiplication_3 = Multiplication(A=nodalvibration.Translation, B=scale_factor)
boundary = BoundarySurfaces(Edges=wbfacepolys)

pt_2 = Point(keysearch)
num_3 = Number(vec)
bnd_2 = Bounds(Numbers=num_3)
num_4 = Number(num_3)
dom_2 = ConstructDomain(DomainStart=Slider(0.01, range=0.01..0.5), DomainEnd=Slider(0.1, range=0.01..0.5))
clr_2 = ColorsAlpaca4d(gradIndex=Slider(0, range=0..12))  # -> colors; inputs gradIndex: Int32; same code as clr
remap_3 = RemapNumbers(Value=num_3, Source=bnd_2, Target=Domain(0, 1))  # -> Mapped, Clipped
remap_4 = RemapNumbers(Value=num_4, Source=bnd_2, Target=dom_2)  # -> Mapped, Clipped
twnthrucols_2 = TweenThroughColors(
    Colors=clr_2,
    Factor=remap_3.Mapped,
    Normalized=True,
    Equalized=False,
    Weighted=False,
    Loopback=False,
    Degree=3,
    InterpolationType=0,
    Alpha=True)
dots_2 = DotDisplay(Point=pt_2, Colour=twnthrucols_2, Size=remap_4.Mapped)

reset = Button()
run = BooleanToggle(False)
smesh = SimpleMesh(Brep=boundary)
python = PythonScript(Run=run, Reset=reset, Interval=update_ms, amplitude=amplitude)  # -> Counter; inputs Run: Boolean
# ---------- python: Python ----------
import Grasshopper as gh
import math

def updateComponent(interval):
    
    """ Updates this component, similar to using a grasshopper timer """
    
    # Define callback action
    def callBack(e):
        ghenv.Component.ExpireSolution(False)
        
    # Get grasshopper document
    ghDoc = ghenv.Component.OnPingDocument()
    
    # Schedule this component to expire
    ghDoc.ScheduleSolution(interval,gh.Kernel.GH_Document.GH_ScheduleDelegate(callBack)) # Note that the first input here is how often to update the component (in milliseconds)

# Instantiate/reset persisent starting counter variable
if "myCounter" not in globals() or Reset:
    myCounter = 0

# Update the variable and component
if Run and not Reset:
    myCounter +=1
    updateComponent(Interval)

# Output counter
Counter = math.sin(myCounter) * amplitude
# ---------- end python ----------
graft_2 = GraftTree(Tree=smesh, IncludeEmptyLists=True, IncludeNullItems=True)
multiplication_4 = Multiplication(A=multiplication_3)
mcol = MeshColours(Mesh=graft_2, Colours=graft(twnthrucols))
move_3 = Move(Geometry=keysearch_4, Motion=multiplication_4)  # -> Geometry, Transform
division = Division()
panel_4 = Panel(python)
vlen = VectorLength(Vector=multiplication_4)
maxdisplacement_2 = Number("2.1")

num_5 = Number(vlen)
pt_3 = Point(move_3.Geometry)
num_6 = Number(num_5)
dom_3 = ConstructDomain(DomainStart=Slider(0.01, range=0.01..0.5), DomainEnd=Slider(0.05, range=0.01..0.5))
clr_3 = ColorsAlpaca4d(gradIndex=Slider(2, range=0..12))  # -> colors; inputs gradIndex: Int32; same code as clr
remap_5 = RemapNumbers(Value=num_5, Source=maxdisplacement_2, Target=Domain(0, 1))  # -> Mapped, Clipped
remap_6 = RemapNumbers(Value=num_6, Source=maxdisplacement_2, Target=dom_3)  # -> Mapped, Clipped
twnthrucols_3 = TweenThroughColors(
    Colors=clr_3,
    Factor=remap_5.Mapped,
    Normalized=True,
    Equalized=False,
    Weighted=False,
    Loopback=False,
    Degree=3,
    InterpolationType=0,
    Alpha=True)
legend_2 = Legend(Colour=clr_3, Tags=["One Fish", "Two Fish", "Red Fish", "Blue Fish"], LegendType=1)
dots_3 = DotDisplay(Point=pt_3, Colour=twnthrucols_3, Size=remap_6.Mapped)

previewlw_3 = CustomPreviewLineweights(Geometry=feabar.LineGeometry, Shader=ColourSwatch(SwatchColor=RGB(0, 0, 0)), Absolute=False)

# ---- group: visualisation: Data on screen
result_1 = Data()
concat = Concatenate(FragmentA="FEM Design", JoinSeparator=" ")
entwine_2 = Entwine(Branch00=concat, Branch02="Shell Internal Force", FlattenInputs=True)  # -> flatten(Result)
entwine_3 = Entwine(Branch00=ColourSwatch(SwatchColor=RGB(0, 0, 0)), FlattenInputs=True)  # -> flatten(Result)
left_right_position_pixels = Panel("50")
spacing_pixels = Panel("30")
up_down_position_pixels = Panel("100")
lng = ListLength(List=entwine_2)
series = Series(Start=up_down_position_pixels, Step=spacing_pixels, Count=lng)
pt_4 = ConstructPoint(XCoordinate=left_right_position_pixels, YCoordinate=series, ZCoordinate=0)
texttoscreen = RenderTextToScreen(Text=entwine_2, Location=pt_4, Size="24", Color=entwine_3, Font="Inconsolata", m_scWithvp=False)
