# Grasshopper definition ConstructionStages.gh (Grasshopper 1.0.7)
# plug-ins: FEM-Design

default = MaterialDatabaseDefault(CountryCode="S")  # -> Steel, Concrete, Timber, Reinforcement, Stratum, Custom
crv = Curve([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])
crv_2 = Curve([<curve referenced from the Rhino model> x4])
crv_3 = Curve([<curve referenced from the Rhino model> x4])
crv_4 = Curve([<curve referenced from the Rhino model> x4])
crv_5 = Curve([<curve referenced from the Rhino model> x4])
pt = Point([Point(0, 0, 0), Point(15, 0, 0), Point(15, 15, 0), Point(0, 15, 0)])
item = ListItem(List=default.Concrete, Index=0, Wrap=True)
boundary = BoundarySurfaces(Edges=crv)
graft = GraftTree(Tree=boundary, IncludeEmptyLists=True, IncludeNullItems=True)  # -> simplify(Tree)
entwine = Entwine(Branch00=crv_2, Branch01=crv_3, Branch02=crv_4, Branch03=crv_5, FlattenInputs=True)  # -> simplify(Result)
pointsupport = PointSupport(Plane=pt, Tx=True, Ty=True, Tz=True, Rx=True, Ry=True, Rz=True, Identifier="S")
plate = SlabPlate(Surface=graft, Material=item, Identifier="P")  # -> simplify(Slab)
beam = BarsBeam(Curve=entwine, Material=item, OrientLCS=True, Identifier="B")  # -> simplify(Bar)
list = ValueList({"ordinary", "dead_load", "soil_dead_load", "shrinkage", "prestressing", "fire", "seis_sxp", "seis_sxm", "seis_syp", "seis_sym"}, selected="dead_load")
list_2 = ValueList({"permanent", "long-term", "medium-term", "short-term", "instantaneous"}, selected="long-term")

# ---- group: Group element with DataTree Structure
data = Data(simplify([beam, plate, pointsupport]))

# ----
create = LoadCaseCreate(Name="myLoad", Type=list, DurationClass=list_2)
Z = UnitZ(Factor="-4.00")
uniform = SurfaceLoadUniform(Surface=graft, Force=Z, LoadCase=create)  # -> flatten(SurfaceLoad)

loadcases = Data(create)
stageload = StageLoad(LoadCase=loadcases, Factor=1, Partitioning=1)

# ----
# Use DataTree information
# to create Stages
elements = Data(simplify(data))
tstat = TreeStatistics(Tree=elements)  # -> Paths, Length, Count
dpath = DeconstructPath(Branch=tstat.Paths)
addition = Addition(A=dpath, B="1")
stage = Stage(Index=addition, Elements=elements, ActivatedLoadCase=stageload, InitialStressState=False)

data_2 = Data(flatten(data))
data_3 = Data(flatten(stage))
create_2 = ModelCreate(CountryCode="S", StructureElements=data_2, Loads=uniform, LoadCases=create, Stages=data_3)
open = ModelOpen(FdModel=create_2, CloseOpenWindows=False, RunNode=Toggle(True))
