# Grasshopper definition ConstructionStages_Advance.gh (Grasshopper 1.0.7)
# plug-ins: FEM-Design, treesloth01

range = Range(Domain=Domain(0, 1), Steps="4")
range_2 = Range(Domain=Domain(0, 1), Steps="4")
vec = VectorXYZ(XComponent=graft(range), YComponent=range_2, ZComponent=0)  # -> flatten(Vector), Length
planesrf = PlaneSurface(Plane=PlaneXY(0, 0, 0), XSize=Domain(-10, 10), YSize=Domain(-10, 10))
rectangle = Rectangle(Plane=PlaneXY(0, 0, 0), XSize="-3.0 to 3.0", YSize="-3.0 to 3.0", Radius=0)  # -> Rectangle, Length
evalsrf = EvaluateSurface(Surface=reparameterize(planesrf), Point=vec.Vector)  # -> Point, Normal, UDirection, VDirection, Frame
series = Series(Start=0, Step="4", Count=10)
debrep = DeconstructBrep(Brep=planesrf)  # -> Faces, Edges, Vertices
Z = UnitZ(Factor=series)  # -> graft(UnitVector)
move = Move(Geometry=rectangle.Rectangle, Motion=Z)  # -> flatten(Geometry), Transform
shift = ShiftList(List=move.Geometry, Shift=1, Wrap=invert(True))
move_2 = Move(Geometry=debrep.Vertices, Motion=Z)  # -> Geometry, Transform
tstat = TreeStatistics(Tree=simplify(move_2.Geometry))  # -> Paths, Length, Count
merge = Merge(Data1=simplify(graft(move.Geometry)), Data2=simplify(graft(shift)))  # -> simplify(Result)
dpath = DeconstructPath(Branch=tstat.Paths)  # -> flatten(Indices)
bnd = Bounds(Numbers=dpath)
loft = Loft(Curves=merge, Options={Adjust=False, Closed=False, LoftEnds=0, LoftSimp=0, LoftType=0, Rebuild=10, Refit=0.01})
remap = RemapNumbers(Value=dpath, Source=bnd, Target=Domain(0, 1))  # -> Mapped, Clipped
clean = CleanTree(RemoveNulls=True, RemoveInvalid=True, RemoveEmpty=invert(False), Tree=loft)
graph = GraphMapper(remap.Mapped, x0=0, x1=1, y0=0, y1=1, container_name="Bezier", cpx=[0, 1, 0, 1], cpy=[0, 1, 0, 1])
debrep_2 = DeconstructBrep(Brep=clean)  # -> Faces, Edges, Vertices
plfit = PlaneFit(Points=move_2.Geometry)  # -> Plane, Deviation
graft = GraftTree(Tree=graph, IncludeEmptyLists=True, IncludeNullItems=True)
move_3 = Move(Geometry=planesrf, Motion=Z)  # -> Geometry, Transform
rotate = Rotate(Geometry=move_2.Geometry, Angle=graft, Plane=plfit.Plane)  # -> Geometry, Transform
rotate_2 = Rotate(Geometry=move_3.Geometry, Angle=graft, Plane=plfit.Plane)  # -> simplify(Geometry), Transform
flip = FlipMatrix(Data=rotate.Geometry)
split = SplitTree(Data=rotate_2.Geometry, Masks=flatten("{0}"))  # -> Positive, simplify(Negative)
pline = PolyLine(Vertices=flip, Closed=False)  # -> simplify(Polyline)
create = LoadCaseCreate(Name="DL", Type="static", DurationClass="permanent")
create_2 = LoadCaseCreate(Name="WIND", Type="static", DurationClass="permanent")
explode = Explode(Curve=pline, Recursive=True)  # -> simplify(Segments), Vertices
renumber = RenumberPaths(Data=split.Negative)
flip_2 = FlipMatrix(Data=explode.Segments)
crv = Curve(flip_2)

# ---- group: Define Load for Stages
stageload = StageLoad(LoadCase=create_2, Factor="2", Partitioning="0")
stageload_2 = StageLoad(LoadCase=create, Factor=1, Partitioning=1)
entwine = Entwine(Branch00=stageload_2, Branch01=stageload, FlattenInputs=True)

# ----
area = Area(Geometry=renumber)  # -> Area, Centroid
Z_2 = UnitZ(Factor="-0.25")
Z_3 = UnitZ(Factor="-0.25")
uniform = SurfaceLoadUniform(Surface=renumber, Force=Z_3, LoadCase=create)  # -> flatten(SurfaceLoad)
force = PointLoadForce(Point=area.Centroid, Force=Z_2, LoadCase=create_2)

plate = SlabPlate(Surface=renumber, Identifier="P")  # -> simplify(Slab)
wall = SlabWall(Surface=debrep_2.Faces, Identifier="P")  # -> simplify(Slab)
beam = BarsBeam(Curve=crv, OrientLCS=True, Identifier="B")  # -> simplify(Bar)

# ---- group: Group element with DataTree Structure
entwine_2 = Entwine(Branch0X=wall, Branch1X=beam, Branch2X=plate, FlattenInputs=False)
path_mapper = PathMapper(entwine_2, source="{a;b}", target="{b;a}")
data = Data(simplify(path_mapper))
renumber_2 = RenumberPaths(Data=data)
tstat_2 = TreeStatistics(Tree=renumber_2)  # -> Paths, Length, Count
dpath_2 = DeconstructPath(Branch=tstat_2.Paths)
addition = Addition(A=dpath_2, B=1)
stage = Stage(Index=addition, Elements=renumber_2, ActivatedLoadCase=entwine, InitialStressState=False)

# ----
relay = Relay([create, create_2])
rigid = PointSupportRigid(Point=debrep.Vertices, Identifier="S")
relay_2 = Relay([beam, plate, rigid, wall])
data_2 = Data(stage)
create_3 = ModelCreate(
    CountryCode="S",
    StructureElements=flatten(relay_2),
    Loads=flatten([uniform, force]),
    LoadCases=relay,
    Stages=flatten(data_2))
open = ModelOpen(FdModel=create_3, CloseOpenWindows=False, RunNode=Toggle(False))
