# Grasshopper definition Orient Support Point.gh (Grasshopper 1.0.7)
# plug-ins: FEM-Design, Bifocals, Human

crv = Curve(reparameterize(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))
range = Range(Domain=Domain(0, 1), Steps="20")
hframe = HorizontalFrame(Curve=crv, Parameter=range)
pointsupport = PointSupport(
    Plane=hframe,
    Tx=Toggle(True),
    Ty=Toggle(False),
    Tz=Toggle(True),
    Rx=Toggle(False),
    Ry=Toggle(True),
    Rz=Toggle(True),
    Identifier="S")
deplane = DeconstructPlane(Plane=hframe)  # -> Origin, XAxis, YAxis, ZAxis
line = LineSDL(Start=deplane.Origin, Direction=deplane.XAxis, Length=1)
line_2 = LineSDL(Start=deplane.Origin, Direction=deplane.YAxis, Length=1)
dash = DashPattern(Curve=crv, Pattern="0.5")  # -> Dashes, Gaps
create = ModelCreate(CountryCode="S", StructureElements=pointsupport)
previewlw = CustomPreviewLineweights(Geometry=line, Shader=ColourSwatch(SwatchColor=RGB(0, 163, 5)), Thickness="5", Absolute=False)
previewlw_2 = CustomPreviewLineweights(Geometry=dash.Dashes, Shader=ColourSwatch(SwatchColor=RGB(138, 138, 138)), Thickness="2", Absolute=False)
previewlw_3 = CustomPreviewLineweights(Geometry=line_2, Shader=ColourSwatch(SwatchColor=RGB(163, 0, 0)), Thickness="5", Absolute=False)
open = ModelOpen(FdModel=create, CloseOpenWindows=False, RunNode=True)
