# Grasshopper definition ResultReader.gh (Grasshopper 1.0.7)
# plug-ins: FEM-Design, Human

list = ValueList({"Reaction": 0, "InternalForce": 1}, selected="InternalForce")
python = GhPythonScript()  # -> out, a
# ---------- python: Python ----------
__author__ = "MarcoPellegrinoKonsu"
__version__ = "2022.08.26"

import rhinoscriptsyntax as rs
import os

a = rs.DocumentPath() + "ReadResult.str"
print(a)
# ---------- end python ----------
gate = StreamGate(Stream=python.a, Gate=list)  # -> Target0, Target1
resultstype = ResultsType({"NodalDisplacement", "PointSupportReaction", "BarDisplacement", "BarInternalForce", "BarStress", "LineSupportGroupReaction", "ShellDisplacement", "ShellInternalForce", "ShellStress", "LabelledSectionInternalForce", "LabelledSectionResultant", "NodalVibrationShape", "EigenFrequencies", "QuantityEstimationConcrete", "QuantityEstimationSteel", "QuantityEstimationTimber", "QuantityEstimationTimberPanel", "QuantityEstimationGeneral", "QuantityEstimationReinforcement"}, selected="PointSupportReaction")
resultstype_2 = ResultsType({"NodalDisplacement", "PointSupportReaction", "BarDisplacement", "BarInternalForce", "BarStress", "LineSupportGroupReaction", "ShellDisplacement", "ShellInternalForce", "ShellStress", "LabelledSectionInternalForce", "LabelledSectionResultant", "NodalVibrationShape", "EigenFrequencies", "QuantityEstimationConcrete", "QuantityEstimationSteel", "QuantityEstimationTimber", "QuantityEstimationTimberPanel", "QuantityEstimationGeneral", "QuantityEstimationReinforcement"}, selected="BarInternalForce")
path = FilePath(gate.Target1)
readstr = ModelReadStr(StrPath=gate.Target0, ResultTypes=resultstype, RunNode=True)  # -> FdModel, FdFeaModel, Results
readstr_2 = ModelReadStr(StrPath=path, ResultTypes=resultstype_2, RunNode=True)  # -> FdModel, FdFeaModel, Results
pointsupportreaction = PointSupportReaction(Result=readstr.Results, CaseCombinationName="myLoad")  # -> CaseIdentifier, Identifier, NodeId, SupportPosition, ReactionForce, ReactionMoment, ForceResultant, MomentResultant
barinternalforce = BarInternalForce(Result=readstr_2.Results, CaseCombinationName="myLoad")  # -> CaseIdentifier, ElementId, PositionResult, Fx, Fy, Fz, Mx, My, Mz
deconstruct = ModelDeconstruct(FdModel=readstr_2.FdModel)  # -> CountryCode, Bars, FictitiousBars, Shells, FictitiousShells, Diaphragms, Panels, Covers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
deconstruct_2 = BarsDeconstruct(Bar=deconstruct.Bars)  # -> Guid, Curve, Type, Material, Section, Connectivity, Eccentricity, LocalY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
avr = Average(Input=barinternalforce.Fx)
vlen = VectorLength(Vector=pointsupportreaction.ReactionForce)
panel = Panel("0.2 to 1.00")
abs = Absolute(Value=flatten(avr))
dom = ConstructDomain(DomainStart="0.4", DomainEnd="1.00")
bnd = Bounds(Numbers=vlen)
graft = GraftTree(Tree=deconstruct_2.Curve, IncludeEmptyLists=True, IncludeNullItems=True)
sort = SortList(Keys=abs)  # -> reverse(Keys), ValuesA
remap = RemapNumbers(Value=vlen, Source=bnd, Target=dom)  # -> Mapped, Clipped
gradient = Gradient(
    LowerLimit="0.4",
    UpperLimit="1.00",
    Parameter=remap.Mapped,
    stops=[0: RGB(0, 128, 0), 0.5: RGB(255, 255, 0), 1: RGB(255, 0, 0)])
item = ListItem(List=sort.Keys, Index=0, Wrap=True)
dom_2 = ConstructDomain(DomainStart=expr("-x", item), DomainEnd=item)
remap_2 = RemapNumbers(Value=avr, Source=dom_2, Target=Domain(0, 1))  # -> Mapped, Clipped
gradient_2 = Gradient(
    LowerLimit=0,
    UpperLimit=1,
    Parameter=remap_2.Mapped,
    stops=[0: RGB(0, 0, 76), 0.0312: RGB(0, 0, 98), 0.0625: RGB(0, 0, 121), 0.0938: RGB(0, 0, 143), 0.125: RGB(0, 0, 166), 0.156: RGB(0, 0, 188)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])
dots = DotDisplay(Point=pointsupportreaction.SupportPosition, Colour=gradient, Size=remap.Mapped)
previewlw = CustomPreviewLineweights(Geometry=graft, Shader=gradient_2, Thickness="4", Absolute=False)
