# Grasshopper definition TrussBridge.gh (Grasshopper 1.0.7)
# plug-ins: FEM-Design

default = SectionDatabaseDefault()
listsectionnames = SectionDatabaseListSectionNames(SectionDatabase=default)
default_2 = MaterialDatabaseDefault(CountryCode="S")  # -> Steel, Concrete, Timber, Reinforcement, Stratum, Custom
item = ListItem(List=listsectionnames, Index="573", Wrap=True)
pt = Point([Point(0, 0, 0), Point(0, 5, 0), Point(32, 0, 0), Point(32, 5, 0)])
getsectionbyname = SectionGetSectionByName(SectionDatabase=default, SectionName=item)
crv = Curve([<curve referenced from the Rhino model> x66])
crv_2 = Curve([<curve referenced from the Rhino model> x9])
crv_3 = Curve([<curve referenced from the Rhino model> x24])
item_2 = ListItem(List=default_2.Steel, Index=0, Wrap=True)
entwine = Entwine(Branch00=crv, Branch01=crv_2, Branch02=crv_3, FlattenInputs=True)
explode = Explode(Curve=entwine, Recursive=True)  # -> Segments, flatten(Vertices)
pointsupport = PointSupport(Plane=pt, Tx=True, Ty=True, Tz=True, Rx=True, Ry=True, Rz=True, Identifier="S")
beam = BarsBeam(Curve=entwine, Material=item_2, Section=getsectionbyname, OrientLCS=True, Identifier="B")  # -> flatten(Bar)
cullpt = CullDuplicates(Points=explode.Vertices, Tolerance="0.01", CullMode=1)  # -> Points, Indices, Valence
create = LoadCaseCreate(Name="myLoad", Type="Ordinary", DurationClass="permanent")
list = ValueList({"ultimate_ordinary", "ultimate_accidental", "ultimate_seismic", "serviceability_quasi_permanent", "serviceability_frequent", "serviceability_characteristic"}, selected="ultimate_accidental")
Z = UnitZ(Factor="-20")
force = PointLoadForce(Point=cullpt.Points, Force=Z, LoadCase=create)
create_2 = LoadCombinationCreate(Name="myCombination", Type=list, LoadCase=create, Gamma="1.0")
create_3 = ModelCreate(
    CountryCode="S",
    StructureElements=flatten([beam, pointsupport]),
    Loads=force,
    LoadCases=create,
    LoadCombinations=create_2)
toggle = BooleanToggle(True)
fdmodel = Data(create_3)
define = AnalysisDefine(
    CalcCase=toggle,
    CalcCstage=False,
    CalcImpf=False,
    CalcComb=toggle,
    CalcGmax=False,
    CalcStab=False,
    CalcFreq=False,
    CalcSeis=False,
    CalcDesign=False,
    CalcFootfall=False,
    Elemfine=False,
    Diaphragm=False,
    PeakSmoothing=False)
define_2 = DesignDefine(AutoDesign=True, Check=True, BasedOn=True, ApplyChanges=Toggle(True))
rundesign = ApplicationRunDesign(
    Mode="steel",
    FdModel=fdmodel,
    Analysis=define,
    Design=define_2,
    EndSession=False,
    CloseOpenWindows=False,
    RunNode=Toggle(True))  # -> FdModel, FdFeaModel, Results, HasExited

# ----
# Initial Model
data = Data(fdmodel)
deconstruct = ModelDeconstruct(FdModel=data)  # -> CountryCode, Bars, FictitiousBars, Shells, FictitiousShells, Diaphragms, Panels, Covers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
deconstruct_2 = BarsDeconstruct(Bar=deconstruct.Bars)  # -> Guid, Curve, Type, Material, Section, Connectivity, Eccentricity, LocalY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
deconstruct_3 = SectionDeconstruct(Section=deconstruct_2.Section)  # -> Guid, Name, Surfaces, SectionType, MaterialType, GroupName, TypeName, SizeName
panel = Panel(deconstruct_3.Name)

# ----
# Optimised Model
data_2 = Data(rundesign.FdModel)
deconstruct_4 = ModelDeconstruct(FdModel=data_2)  # -> CountryCode, Bars, FictitiousBars, Shells, FictitiousShells, Diaphragms, Panels, Covers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
deconstruct_5 = BarsDeconstruct(Bar=deconstruct_4.Bars)  # -> Guid, Curve, Type, Material, Section, Connectivity, Eccentricity, LocalY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
deconstruct_6 = SectionDeconstruct(Section=deconstruct_5.Section)  # -> Guid, Name, Surfaces, SectionType, MaterialType, GroupName, TypeName, SizeName
panel_2 = Panel(deconstruct_6.Name)
