# Grasshopper definition trussExample.gh (Grasshopper 1.0.7)
# plug-ins: FEM-Design, Human, treesloth01, Pufferfish, Chromodoris, Alpaca4d

height = Slider(2.7, range=2..5)
subdivision = Slider(6, range=2..12)
X = UnitX(Factor=1)
pt = Point(Point(0, 0, 0))
line = LineSDL(Start=pt, Direction=X, Length=Slider(18, range=6..18))
Z = UnitZ(Factor=height)
move = Move(Geometry=line, Motion=Z)  # -> Geometry, Transform
merge = Merge(Data1=line, Data2=move.Geometry)
divide = DivideCurve(Curve=merge, Count=subdivision, Kinks=False)  # -> Points, Tangents, Parameters

top_bottom_points = Geometry(divide.Points)
item = ListItem(List=top_bottom_points, Index=0, Wrap=True)  # -> Item1, Item
flip = FlipMatrix(Data=top_bottom_points)
pline = PolyLine(Vertices=flip, Closed=False)
ln = Line(StartPoint=item.Item, EndPoint=item.Item1)
top_bottom_chord = Curve(ln)
vertical = Curve(pline)

geo = Geometry(divide.Points)
bang = ExplodeTree(Data=geo)  # -> Branch0, Branch1
shift = ShiftList(List=bang.Branch0, Shift=1, Wrap=invert(True))
shift_2 = ShiftList(List=bang.Branch1, Shift=1, Wrap=True)
ln_2 = Line(StartPoint=bang.Branch1, EndPoint=shift)
ln_3 = Line(StartPoint=bang.Branch0, EndPoint=shift_2)
cull_i = CullIndex(List=ln_2, Indices="-1", Wrap=True)
cull_i_2 = CullIndex(List=ln_3, Indices="-1", Wrap=True)
merge_2 = Merge(Data1=Toggle(False), Data2=Toggle(True))
cull = CullPattern(List=cull_i, CullPattern=invert(merge_2))
cull_2 = CullPattern(List=cull_i_2, CullPattern=merge_2)
merge_3 = Merge(Data1=cull_2, Data2=cull)  # -> flatten(Result)
diagonals = Curve(merge_3)

load_case_table = Panel("""DL,dead_load,permanent
IL,ordinary,permanent
WIND,ordinary,permanent""")
split = TextSplit(Text=load_case_table, Separators=",")
panel = Panel(split)
item_2 = ListItem(List=panel, Index=0, Wrap=True)  # -> Item, Item1, Item2
construct = LoadCaseConstruct(Name=item_2.Item, Type=item_2.Item1, DurationClass=item_2.Item2)  # -> flatten(LoadCase)
panel_2 = Panel(construct)

load_combination_table = Panel("""NAME,DL,IL,WIND
COMBO_1,1.35,1.35,1.00
COMBO_2,1.00,1.5,1.5
COMBO_3,1.00,0.00,0.00""")
split_2 = SplitList(List=load_combination_table, Index="1")  # -> ListA, ListB
split_3 = TextSplit(Text=split_2.ListB, Separators=",")
split_4 = SplitList(List=split_3, Index="1")  # -> ListA, ListB
name = Data(split_4.ListA)
gamma = Data(split_4.ListB)

default = SectionDatabaseDefault()  # -> SteelSection, ConcreteSection, TimberSection, HollowCoreSection, CustomSection
panel_3 = Panel(default.SteelSection)

sections = Data(default.SteelSection)
getsectionbyname_index = SectionGetSectionByNameIndex(Sections=sections, SectionNameIndex="Steel sections, HE-B, 120")

materials = Data(default.SteelSection)
getsectionbyname_index_2 = SectionGetSectionByNameIndex(Sections=materials, SectionNameIndex="Steel sections, HE-B, 300")

sections_2 = Data(default.SteelSection)

getsectionbyname_index_3 = SectionGetSectionByNameIndex(Sections=sections_2, SectionNameIndex="70")

construct_2 = LoadCombinationConstruct(Name=name, Type="ultimate_ordinary", LoadCase=construct, Gamma=gamma)  # -> flatten(LoadCombination)
panel_4 = Panel(construct_2)

default_2 = MaterialDatabaseDefault(CountryCode="S")  # -> SteelMaterial, ConcreteMaterial, TimberMaterial, ReinforcementMaterial, StratumMaterial, CustomMaterial
panel_5 = Panel(default_2.SteelMaterial)
section = Data(getsectionbyname_index)
section_2 = Data(getsectionbyname_index_2)

materials_2 = Data(default_2.SteelMaterial)
getmaterialbyname_index = MaterialGetMaterialByNameIndex(Materials=materials_2, MaterialNameIndex="S 355")

materials_3 = Data(default_2.SteelMaterial)
getmaterialbyname_index_2 = MaterialGetMaterialByNameIndex(Materials=materials_3, MaterialNameIndex="2")

top_bottom_points_2 = Geometry(simplify(top_bottom_points))
load_cases = Data(construct)
path = ConstructPath(Indices="0")
path_2 = ConstructPath(Indices="1")
item_3 = ListItem(List=load_cases, Index=0, Wrap=True)  # -> Item, Item1, Item2
branch = TreeBranch(Tree=top_bottom_points_2, Path=path_2, MaintainPaths=True)
branch_2 = TreeBranch(Tree=top_bottom_points_2, Path=path, MaintainPaths=True)
material = Data(getmaterialbyname_index)
fline = FitLine(Points=branch)
hinged = ConnectivityHinged()
hinged_2 = ConnectivityHinged()
pt_2 = Point(item.Item)
material_2 = Data(material)
crv = Curve(top_bottom_chord)
section_3 = Data(section_2)
material_3 = Data(material)
crv_2 = Curve([vertical, diagonals])
section_4 = Data(section)
Y = UnitY(Factor="2.00")
Z_2 = UnitZ(Factor="-10")
Z_3 = UnitZ(Factor="4.00")
loadcase = Data(item_3.Item1)
loadcase_2 = Data(item_3.Item2)
loadcase_3 = Data(item_3.Item1)
force = LineLoadForce(Curve=fline, StartForce=Y, LoadCase=loadcase_3, ConstLoadDir=True, LoadProjection=False)
force_2 = PointLoadForce(Point=branch_2, Force=Z_2, LoadCase=loadcase)
force_3 = PointLoadForce(Point=branch_2, Force=Z_3, LoadCase=loadcase_2)
toggle = BooleanToggle(True)
toggle_2 = BooleanToggle(True)
Z_4 = UnitZ(Factor=1)
simple = PointSupportSimple(Plane=pt_2, Tx=toggle, Ty=toggle, Tz=toggle, Rx=toggle_2, Ry=toggle_2, Rz=toggle_2, Identifier="S")
beam = BarsBeam(Curve=crv, Material=material_2, Section=section_3, Connectivity=hinged, LocalY=Z_4, OrientLCS=True, Identifier="B")
beam_2 = BarsBeam(Curve=crv_2, Material=material_3, Section=section_4, Connectivity=hinged_2, OrientLCS=True, Identifier="B")
loads = Data(flatten([force_2, force_3, force]))
data = Data(simple)
bar = Data(beam)
loadcombinations = Data(flatten(construct_2))
loadcases = Data(flatten(construct))
elements = Data(flatten([bar, beam_2, data]))
loads_2 = Data(flatten(loads))
construct_3 = ModelConstruct(CountryCode="S", StructureElements=elements, Loads=loads_2, LoadCases=loadcases, LoadCombinations=loadcombinations)
fdmodel = Data(construct_3)
resultstype = ResultsType({"NodalDisplacement", "PointSupportReaction", "PointSupportReactionMinMax", "BarDisplacement", "BarInternalForce", "BarStress", "LineSupportReaction", "ShellDisplacement", "ShellInternalForce", "ShellStress", "LabelledSectionInternalForce", "LabelledSectionResultant", "NodalVibrationShape", "EigenFrequencies", "QuantityEstimationConcrete", "QuantityEstimationSteel", "QuantityEstimationTimber", "QuantityEstimationTimberPanel", "QuantityEstimationGeneral", "QuantityEstimationReinforcement"}, selected=["NodalDisplacement", "PointSupportReaction", "BarDisplacement", "BarInternalForce"])
fdmodel_2 = Data(fdmodel)
toggle_3 = BooleanToggle(True)
define = AnalysisDefine(
    CalcCase=toggle_3,
    CalcCstage=False,
    CalcImpf=False,
    CalcComb=toggle_3,
    CalcGmax=False,
    CalcStab=False,
    CalcFreq=False,
    CalcSeis=False,
    CalcDesign=False,
    CalcFootfall=False,
    Elemfine=False,
    Diaphragm=False,
    PeakSmoothing=False)
resulttypes = Data(resultstype)
analysis = Data(define)
fdmodel_3 = Data(fdmodel_2)
runanalysis = ApplicationRunAnalysis(
    FdModel=fdmodel_3,
    Analysis=analysis,
    ResultTypes=resulttypes,
    EndSession=Toggle(True),
    CloseOpenWindows=False,
    RunNode=Toggle(False))  # -> FdModel, FdFeaModel, Results, HasExited

# ----
# Nodal Displacement
branch_3 = TreeBranch(Tree=runanalysis.Results, Path="0", MaintainPaths=True)
nodaldisplacement = NodalDisplacement(Result=branch_3, CaseCombinationName="DL")  # -> CaseIdentifier, NodeId, Translation, Rotation
feanode = FdFeaModelFeaNode(FdFeaModel=runanalysis.FdFeaModel)  # -> NodeId, Point
vlen = VectorLength(Vector=nodaldisplacement.Translation)
subtraction = Subtraction(A=nodaldisplacement.NodeId, B=1)
item_4 = ListItem(List=feanode.Point, Index=subtraction, Wrap=True)
bnd = Bounds(Numbers=vlen)
dedomain = DeconstructDomain(Domain=bnd)  # -> Start, End
gradient = Gradient(
    LowerLimit=dedomain.Start,
    UpperLimit=dedomain.End,
    Parameter=vlen,
    stops=[0: RGB(10, 0, 0), 0.0312: RGB(31, 0, 0), 0.0625: RGB(52, 0, 0), 0.0938: RGB(73, 0, 0), 0.125: RGB(94, 0, 0), 0.156: RGB(115, 0, 0)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])
dots = DotDisplay(Point=item_4, Colour=gradient, Size="0.25")
tag = TextTag(Location=item_4, Text=vlen)

branch_4 = TreeBranch(Tree=runanalysis.Results, Path="2", MaintainPaths=True)
python = GhPythonScript(x=branch_4)  # -> out, a
# ---------- python: Python ----------
__author__ = "MarcoPellegrinoKonsu"
__version__ = "2022.09.15"

import rhinoscriptsyntax as rs

a = x.CaseIdentifier
# ---------- end python ----------
cset = CreateSet(List=python.a)  # -> Set, Map
item_5 = ListItem(List=cset.Set, Index="0", Wrap=True)
bardisplacement = BarDisplacement(Result=branch_4, CaseCombinationName=item_5)  # -> CaseIdentifier, ElementId, PositionResult, Translation, Rotation
feabar = FdFeaModelFeaBar(FdFeaModel=runanalysis.FdFeaModel)  # -> Identifier, ElementId, NodeI, NodeJ, LineGeometry
join = JoinCurves(Curves=feabar.LineGeometry, Preserve=False)
vlen_2 = VectorLength(Vector=bardisplacement.Translation)
bnd_2 = Bounds(Numbers=flatten(vlen_2))
dedomain_2 = DeconstructDomain(Domain=bnd_2)  # -> Start, End
gradient_2 = Gradient(
    LowerLimit=dedomain_2.Start,
    UpperLimit=dedomain_2.End,
    Parameter=vlen_2,
    stops=[0: RGB(10, 0, 0), 0.0312: RGB(31, 0, 0), 0.0625: RGB(52, 0, 0), 0.0938: RGB(73, 0, 0), 0.125: RGB(94, 0, 0), 0.156: RGB(115, 0, 0)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])

# ----
# FEM-Design Model
fdfeamodel = Data(runanalysis.FdFeaModel)
feabar_2 = FdFeaModelFeaBar(FdFeaModel=fdfeamodel)  # -> Identifier, ElementId, NodeI, NodeJ, LineGeometry
feanode_2 = FdFeaModelFeaNode(FdFeaModel=fdfeamodel)  # -> NodeId, Point
group = Group(Objects=[feanode_2.Point, feabar_2.LineGeometry])
previewlw = CustomPreviewLineweights(Geometry=group, Shader=ColourSwatch(SwatchColor=RGB(0, 178, 209)), Thickness="2", Absolute=False)

# ----
# 3d model with Results
eval = EvaluateLength(Curve=join, Length=bardisplacement.PositionResult, Normalized=invert(True))  # -> Point, Tangent, Parameter

deconstruct = ModelDeconstruct(FdModel=runanalysis.FdModel)  # -> CountryCode, Bars, FictitiousBars, Shells, FictitiousShells, Diaphragms, Panels, Covers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
graft = GraftTree(Tree=deconstruct.Bars, IncludeEmptyLists=True, IncludeNullItems=True)
deconstruct_2 = BarsDeconstruct(Bar=graft)  # -> Guid, Curve, Type, Material, Section, Connectivity, Eccentricity, LocalY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
deconstruct_3 = SectionDeconstruct(Section=deconstruct_2.Section)  # -> Guid, Name, simplify(Surfaces), SectionType, MaterialType, GroupName, TypeName, SizeName
shift_3 = ShiftPaths(Data=deconstruct_3.Surfaces, Offset=-1)
xprod = CrossProduct(VectorA=deconstruct_2.Curve, VectorB=deconstruct_2.LocalY, Unitize=False)  # -> Vector, Length
explode = Explode(Curve=deconstruct_2.Curve, Recursive=True)  # -> Segments, Vertices
pl = ConstructPlane(Origin=explode.Vertices, XAxis=xprod.Vector, YAxis=deconstruct_2.LocalY)
orient = Orient(Geometry=shift_3, Source=PlaneXY(0, 0, 0), Target=pl)  # -> Geometry, Transform
debrep = DeconstructBrep(Brep=orient.Geometry)  # -> Faces, Edges, Vertices
join_2 = JoinCurves(Curves=debrep.Edges, Preserve=False)  # -> simplify(Curves)
item_6 = ListItem(List=join_2, Index=0, Wrap=True)
lng = ListLength(List=bardisplacement.Translation)
topoly = CurveToPolyline(Curve=item_6, ToleranceDistance=0, ToleranceAngle=0)  # -> simplify(Polyline), Segments
range = Range(Domain=Domain(0, 1), Steps=expr("x-1", lng))
shift_4 = ShiftPaths(Data=topoly.Polyline, Offset=-1)
twnthrucrvs = TweenThroughCurves(
    Curves=shift_4,
    Factor=range,
    Normalized=True,
    Equalized=False,
    Loopback=False,
    InterpolationType=0,
    Refit=0,
    PointSample=0)
mloft = MeshLoft(Polylines=twnthrucrvs, Cap=False)  # -> simplify(Mesh)
colors = Data(gradient_2)

ml = MeshLoftAlpaca4d(Polylines=twnthrucrvs)

panel_6 = Panel("-0.2")
number_slider = Slider(3.3, range=1..10)
number_slider_2 = Slider(1, range=1..10)
negative = Negative(Value=Slider(0.14, range=0..10))
unit_z = UnitZ(Factor=negative)
xy_plane = XYPlane(Origin=Point(0, 0, 0))
panel_7 = Panel("1")
move_2 = Move(Geometry=xy_plane, Motion=unit_z)  # -> Geometry, Transform
mesh = Mesh(flatten(ml))
vector_xyz = VectorXYZ(XComponent=0, YComponent=number_slider_2, ZComponent=number_slider_2)  # -> Vector, Length
loft = Loft(Curves=twnthrucrvs, Options={Adjust=False, Closed=False, LoftEnds=0, LoftSimp=0, LoftType=0, Rebuild=10, Refit=0.01})
mesh_join = MeshJoin(Meshes=mesh)
custom_preview = CustomPreview(Geometry=loft, Material=ColourSwatch(SwatchColor=RGBA(0, 178, 209, 93)))
mesh_shadow = MeshShadow(Mesh=mesh_join, Light=vector_xyz.Vector, Plane=move_2.Geometry)
boundary_surfaces = BoundarySurfaces(Edges=mesh_shadow)
custom_preview_2 = CustomPreview(Geometry=boundary_surfaces, Material=ColourSwatch(SwatchColor=RGBA(219, 219, 219, 93)))

demesh = DeconstructMesh(Mesh=ml)  # -> Vertices, Faces, Colours, Normals
cp = ClosestPoint(Point=demesh.Vertices, Cloud=eval.Point)  # -> ClosestPoint, CPIndex, Distance
item_7 = ListItem(List=colors, Index=cp.CPIndex, Wrap=True)
conmesh = ConstructMesh(Vertices=demesh.Vertices, Faces=demesh.Faces, Colours=item_7)
