# Grasshopper definition Serpentine Pavillon 2016_SHARED.gh (Grasshopper 1.0.7)

number_slider = Slider(0.4, range=0..1)

# ---- group: Base Point
pt = Point(Point(-10, -10, 0))

# ---- group: Right side
crv = Curve([<curve referenced from the Rhino model> x4])

# ---- group: Left side
crv_2 = Curve([<curve referenced from the Rhino model> x4])

# ----
yz = YZPlane(Origin=pt)
loft = Loft(Curves=crv_2, Options={Adjust=False, Closed=False, LoftEnds=0, LoftSimp=0, LoftType=0, Rebuild=10, Refit=0.01})
loft_2 = Loft(Curves=crv, Options={Adjust=False, Closed=False, LoftEnds=0, LoftSimp=0, LoftType=0, Rebuild=10, Refit=0.01})
recgrid = Rectangular(
    Plane=yz,
    SizeX=Slider(0.5, range=0..1),
    SizeY=number_slider,
    ExtentX=Slider(51, range=0..100),
    ExtentY=Slider(33, range=0..100))  # -> Cells, Points
disc = Discontinuity(Curve=recgrid.Cells, Level=1)  # -> Points, Parameters
X = UnitX(Factor=1)
X_2 = UnitX(Factor=1)
avr = Average(Input=disc.Points)
project = ProjectPoint(Point=avr, Direction=X, Geometry=loft_2)  # -> Point, Index
project_2 = ProjectPoint(Point=avr, Direction=X_2, Geometry=loft)  # -> Point, Index
number_slider_2 = Slider(0.01, range=0..0.01)

# ---- group: Projecting points to YX plane for accuracy
yz_2 = YZPlane(Origin=Point(0, 0, 0))
project_3 = Project(Geometry=project_2.Point, Plane=yz_2)  # -> Geometry, Transform
dist = Distance(PointA=project_2.Point, PointB=project_3.Geometry)
smaller = SmallerThan(FirstNumber=dist, SecondNumber=number_slider_2)  # -> SmallerThan, OrEqualTo
dispatch = Dispatch(List=project_3.Geometry, DispatchPattern=smaller.SmallerThan)  # -> ListA, ListB
dispatch_2 = Dispatch(List=project_2.Point, DispatchPattern=smaller.SmallerThan)  # -> ListA, ListB
merge = Merge(Data1=dispatch_2.ListB, Data2=dispatch.ListA)

# ---- group: Projecting points to YZ plane for accuracy
yz_3 = YZPlane(Origin=Point(0, 0, 0))
project_4 = Project(Geometry=project.Point, Plane=yz_3)  # -> Geometry, Transform
dist_2 = Distance(PointA=project.Point, PointB=project_4.Geometry)
smaller_2 = SmallerThan(FirstNumber=dist_2, SecondNumber=number_slider_2)  # -> SmallerThan, OrEqualTo
dispatch_3 = Dispatch(List=project_4.Geometry, DispatchPattern=smaller_2.SmallerThan)  # -> ListA, ListB
dispatch_4 = Dispatch(List=project.Point, DispatchPattern=smaller_2.SmallerThan)  # -> ListA, ListB
merge_2 = Merge(Data1=dispatch_4.ListB, Data2=dispatch_3.ListA)

# ----
vec2pt = Vector2Pt(PointA=avr, PointB=merge, Unitize=False)  # -> Vector, Length
vec2pt_2 = Vector2Pt(PointA=avr, PointB=merge_2, Unitize=False)  # -> Vector, Length
move = Move(Geometry=graft(recgrid.Cells), Motion=vec2pt_2.Vector)  # -> Geometry, Transform
move_2 = Move(Geometry=graft(recgrid.Cells), Motion=vec2pt.Vector)  # -> Geometry, Transform

# ---- group: Cleaning up the data structure
clean = CleanTree(RemoveNulls=True, RemoveInvalid=True, RemoveEmpty=True, Tree=move_2.Geometry)
clean_2 = CleanTree(RemoveNulls=True, RemoveInvalid=True, RemoveEmpty=True, Tree=merge)

clean_3 = CleanTree(RemoveNulls=True, RemoveInvalid=True, RemoveEmpty=True, Tree=move.Geometry)
clean_4 = CleanTree(RemoveNulls=True, RemoveInvalid=True, RemoveEmpty=True, Tree=merge_2)

# ----
panel = Panel("""{+1;-1}
{+1;+1}
{-1;-1}
{-1;+1}
{0;+2}
{0;-2}""")
crv_3 = Curve(simplify(clean))
pt_2 = Point(simplify(clean_2))
pt_3 = Point(simplify(clean_4))
crv_4 = Curve(simplify(clean_3))

# ---- group: Getting the neighboring info
relitem = RelativeItem(Tree=pt_3, Offset=panel, WrapPaths=False, WrapItems=False)  # -> ItemA, ItemB

# ---- group: Extruding our bricks
pt_4 = Point(relitem.ItemB)
crv_5 = Curve(crv_4)
pt_5 = Point(relitem.ItemA)

# ----
panel_2 = Panel("""{+1;-1}
{+1;+1}
{-1;-1}
{-1;+1}
{0;+2}
{0;-2}""")
pt_6 = Point(simplify(pt_2))

# ---- group: Getting the neighboring info
relitem_2 = RelativeItem(Tree=pt_6, Offset=panel_2, WrapPaths=False, WrapItems=False)  # -> ItemA, ItemB

# ---- group: Extruding our bricks
pt_7 = Point(relitem_2.ItemB)
crv_6 = Curve(crv_3)
pt_8 = Point(relitem_2.ItemA)

# ---- group: Finetuning the wall / heigth brick
num = Number(number_slider)

num_2 = Number(number_slider)

# ---- group: Extruding our bricks
yz_4 = YZPlane(Origin=pt_5)
project_5 = Project(Geometry=relitem.ItemB, Plane=yz_4)  # -> Geometry, Transform
ln = Line(StartPoint=relitem.ItemB, EndPoint=project_5.Geometry)
plcoord = PlaneCoordinates(Point=pt_4, System=yz_4)  # -> XCoordinate, YCoordinate, ZCoordinate
sort = SortList(Keys=plcoord.ZCoordinate)  # -> Keys, ValuesA
smaller_3 = SmallerThan(FirstNumber=sort.Keys, SecondNumber=0)  # -> SmallerThan, OrEqualTo
dispatch_5 = Dispatch(List=sort.Keys, DispatchPattern=smaller_3.SmallerThan)  # -> ListA, ListB
tolerance = Slider(0.01, range=0..1)
item = ListItem(List=reverse(dispatch_5.ListB), Index=0, Wrap=True)
item_2 = ListItem(List=dispatch_5.ListA, Index=0, Wrap=True)
number_slider_3 = Slider(0.5, range=0..1)

# ---- group: Extruding our bricks / Replacing Nulls and values smaller then our tolerance with tolerance
nullrep = ReplaceNulls(Items=item, Replacements=tolerance)  # -> Items, Count
nullrep_2 = ReplaceNulls(Items=item_2, Replacements=tolerance)  # -> Items, Count
neg = Negative(Value=tolerance)
max = Maximum(A=nullrep.Items, B=tolerance)
min = Minimum(A=nullrep_2.Items, B=neg)

# ---- group: Extruding our bricks
yz_5 = YZPlane(Origin=pt_8)
project_6 = Project(Geometry=relitem_2.ItemB, Plane=yz_5)  # -> Geometry, Transform
ln_2 = Line(StartPoint=relitem_2.ItemB, EndPoint=project_6.Geometry)
plcoord_2 = PlaneCoordinates(Point=pt_7, System=yz_5)  # -> XCoordinate, YCoordinate, ZCoordinate
sort_2 = SortList(Keys=plcoord_2.ZCoordinate)  # -> Keys, ValuesA
smaller_4 = SmallerThan(FirstNumber=sort_2.Keys, SecondNumber=0)  # -> SmallerThan, OrEqualTo
dispatch_6 = Dispatch(List=sort_2.Keys, DispatchPattern=smaller_4.SmallerThan)  # -> ListA, ListB
tolerance_2 = Slider(0.01, range=0..1)
item_3 = ListItem(List=reverse(dispatch_6.ListB), Index=0, Wrap=True)
item_4 = ListItem(List=dispatch_6.ListA, Index=0, Wrap=True)
number_slider_4 = Slider(0.5, range=0..1)

# ---- group: Extruding our bricks / Replacing Nulls and values smaller then our tolerance with tolerance
nullrep_3 = ReplaceNulls(Items=item_3, Replacements=tolerance_2)  # -> Items, Count
nullrep_4 = ReplaceNulls(Items=item_4, Replacements=tolerance_2)  # -> Items, Count
neg_2 = Negative(Value=tolerance_2)
max_2 = Maximum(A=nullrep_3.Items, B=tolerance_2)
min_2 = Minimum(A=nullrep_4.Items, B=neg_2)

# ---- group: Extruding our bricks (continued)
multiplication = Multiplication(A=max, B=number_slider_3)
multiplication_2 = Multiplication(A=min, B=number_slider_3)
abs = Absolute(Value=multiplication_2)
abs_2 = Absolute(Value=multiplication)

# ---- group: Extruding our bricks / Checkerboard pattern
panel_3 = Panel("""{(0,2,...);(0,2,...)}
{(1,3,...);(1,3,...)}""")
split = SplitTree(Data=crv_5, Masks=flatten(panel_3))  # -> RectanglesR, RectanglesL
split_2 = SplitTree(Data=abs, Masks=flatten(panel_3))  # -> NegativeR, NegativeL
split_3 = SplitTree(Data=abs_2, Masks=flatten(panel_3))  # -> PositveR, PositiveL

# ---- group: Extruding our bricks (continued)
addition = Addition(A=split_2.NegativeR, B=split_3.PositveR)
X_3 = UnitX(Factor=expr("X*-1", split_2.NegativeR))
move_3 = Move(Geometry=split.RectanglesR, Motion=X_3)  # -> Geometry, Transform
X_4 = UnitX(Factor=addition)

# ---- group: Extruding our bricks / Exact bricks
extr = Extrude(Base=move_3.Geometry, Direction=X_4)

# ---- group: Rectangles
crv_7 = Curve(split.RectanglesR)

# ---- group: extrusion lengths
num_3 = Number(addition)

# ----
number_slider_5 = Slider(6, range=0..10)
bnd = Bounds(Numbers=flatten(num_3))
dom = ConstructDomain(DomainStart=Slider(0.4, range=0..10), DomainEnd=Slider(1, range=0..10))
range = Range(Domain=dom, Steps=expr("x-1", number_slider_5))
remap = RemapNumbers(Value=num_3, Source=bnd, Target=Domain(0, 1))  # -> Mapped, Clipped
div = DivideDomain(Domain=Domain(0, 1), Count=number_slider_5)
different_extrusion_lengths_bricks = Panel(range)
fdom = FindDomain(Domains=div, Number=remap.Mapped, Strict=False)  # -> Index, Neighbour
item_5 = ListItem(List=range, Index=fdom.Index, Wrap=True)
original_extrusion_lengths = Panel(num_3)
X_5 = UnitX(Factor=expr("X*-0.5", item_5))
standardized_extrusion_lengths = Panel(item_5)
move_4 = Move(Geometry=crv_7, Motion=X_5)  # -> Geometry, Transform
X_6 = UnitX(Factor=item_5)

# ---- group: Bricks with standardized lengths
extr_2 = Extrude(Base=move_4.Geometry, Direction=X_6)

# ---- group: Finetuning the wall / bricks
brep = Brep(extr_2)

# ---- group: Finetuning the wall
split_4 = SplitTree(Data=brep, Masks=flatten("{*;0}"))  # -> Positive, Negative
neg_3 = Negative(Value=num)
Z = UnitZ(Factor=neg_3)
move_5 = Move(Geometry=split_4.Negative, Motion=Z)  # -> Geometry, Transform
path_mapper = PathMapper(move_5.Geometry, source="{A;B}", target="{A;B-1}")

# ---- group: Finetuning the wall / final bricks
brep_2 = Brep(flatten(path_mapper))

# ----
brep_3 = Brep(brep_2)

# ---- group: Extruding our bricks (continued)
multiplication_3 = Multiplication(A=max_2, B=number_slider_4)
multiplication_4 = Multiplication(A=min_2, B=number_slider_4)
abs_3 = Absolute(Value=multiplication_4)
abs_4 = Absolute(Value=multiplication_3)

# ---- group: Extruding our bricks / Checkerboard pattern
panel_4 = Panel("""{(0,2,...);(0,2,...)}
{(1,3,...);(1,3,...)}""")
split_5 = SplitTree(Data=crv_6, Masks=flatten(panel_4))  # -> RectanglesR, RectanglesL
split_6 = SplitTree(Data=abs_3, Masks=flatten(panel_4))  # -> NegativeR, NegativeL
split_7 = SplitTree(Data=abs_4, Masks=flatten(panel_4))  # -> PositveR, PositiveL

# ---- group: Extruding our bricks (continued)
addition_2 = Addition(A=split_6.NegativeR, B=split_7.PositveR)
X_7 = UnitX(Factor=expr("X*-1", split_6.NegativeR))
move_6 = Move(Geometry=split_5.RectanglesR, Motion=X_7)  # -> Geometry, Transform
X_8 = UnitX(Factor=addition_2)

# ---- group: Extruding our bricks / Exact bricks
extr_3 = Extrude(Base=move_6.Geometry, Direction=X_8)

# ---- group: Rectangles
crv_8 = Curve(split_5.RectanglesR)

# ---- group: extrusion lengths
num_4 = Number(addition_2)

# ----
number_slider_6 = Slider(6, range=0..10)
bnd_2 = Bounds(Numbers=flatten(num_4))
dom_2 = ConstructDomain(DomainStart=Slider(0.4, range=0..10), DomainEnd=Slider(1, range=0..10))
range_2 = Range(Domain=dom_2, Steps=expr("x-1", number_slider_6))
remap_2 = RemapNumbers(Value=num_4, Source=bnd_2, Target=Domain(0, 1))  # -> Mapped, Clipped
div_2 = DivideDomain(Domain=Domain(0, 1), Count=number_slider_6)
different_extrusion_lengths_bricks_2 = Panel(range_2)
fdom_2 = FindDomain(Domains=div_2, Number=remap_2.Mapped, Strict=False)  # -> Index, Neighbour
item_6 = ListItem(List=range_2, Index=fdom_2.Index, Wrap=True)
original_extrusion_lengths_2 = Panel(num_4)
X_9 = UnitX(Factor=expr("X*-0.5", item_6))
standardized_extrusion_lengths_2 = Panel(item_6)
move_7 = Move(Geometry=crv_8, Motion=X_9)  # -> Geometry, Transform
X_10 = UnitX(Factor=item_6)

# ---- group: Bricks with standardized lengths
extr_4 = Extrude(Base=move_7.Geometry, Direction=X_10)

# ---- group: Finetuning the wall / bricks
brep_4 = Brep(extr_4)

# ---- group: Finetuning the wall
split_8 = SplitTree(Data=brep_4, Masks=flatten("{*;0}"))  # -> Positive, Negative
neg_4 = Negative(Value=num_2)
Z_2 = UnitZ(Factor=neg_4)
move_8 = Move(Geometry=split_8.Negative, Motion=Z_2)  # -> Geometry, Transform
path_mapper_2 = PathMapper(move_8.Geometry, source="{A;B}", target="{A;B-1}")

# ---- group: Finetuning the wall / final bricks
brep_5 = Brep(flatten(path_mapper_2))

# ----
brep_6 = Brep(brep_5)
bbx = BrepBrep(BrepA=brep_6, BrepB=brep_3)  # -> Curves, Points
lng = ListLength(List=bbx.Curves)
equals = Equality(FirstNumber=lng, SecondNumber="0")  # -> flatten(Equality), Inequality
dispatch_7 = Dispatch(List=brep_6, DispatchPattern=invert(equals.Equality))  # -> ListA, ListB
dispatch_8 = Dispatch(List=brep_3, DispatchPattern=invert(equals.Equality))  # -> ListA, ListB
edges = BrepEdges(Brep=dispatch_8.ListA)  # -> Naked, Interior, NonManifold
edges_2 = BrepEdges(Brep=dispatch_7.ListA)  # -> Naked, Interior, NonManifold
item_7 = ListItem(List=edges_2.Naked, Index=0, Wrap=True)  # -> Item3, Item2, Item1, Item, Item1_2, Item2_2, Item3_2, Item4
item_8 = ListItem(List=edges.Naked, Index=0, Wrap=True)  # -> Item, Item1, Item2, Item3, Item4
crv_9 = Curve([item_8.Item, item_8.Item2, item_8.Item3, item_8.Item4])
crv_10 = Curve([item_7.Item3, item_7.Item1_2, item_7.Item1, item_7.Item2])
join = JoinCurves(Curves=crv_9, Preserve=False)  # -> simplify(Curves)
join_2 = JoinCurves(Curves=crv_10, Preserve=False)
brep_7 = Brep(dispatch_8.ListB)
brep_8 = Brep(dispatch_7.ListB)
flip = FlipCurve(Curve=join_2, Guide=join)  # -> simplify(Curve), Flag
loft_3 = Loft(
    Curves=[flip.Curve, join],
    Options={Adjust=False, Closed=False, LoftEnds=0, LoftSimp=0, LoftType=0, Rebuild=10, Refit=0.01})  # -> flatten(Loft)
brep_9 = Brep(loft_3)
brep_10 = Brep(brep_8)
brep_11 = Brep(brep_7)
entwine = Entwine(Branch00=brep_9, Branch01=brep_10, Branch02=brep_11, FlattenInputs=True)
debrep = DeconstructBrep(Brep=entwine)  # -> Faces, Edges, Vertices
preview = CustomPreview(Geometry=entwine, Material=ColourSwatch(SwatchColor=RGB(199, 255, 255)))
