# Grasshopper definition parametric_truss.gh (Grasshopper 1.0.7)
# plug-ins: LunchBox, FEM-Design

crv = Curve([<curve referenced from the Rhino model> x5])
loft = Loft(Curves=crv, Options={Adjust=False, Closed=False, LoftEnds=0, LoftSimp=0, LoftType=0, Rebuild=10, Refit=0.01})
srf = Surface(loft)
neg = Negative(Value=Slider(2.28, range=1..4))
spacetruss_1 = SpaceTrussStructure1(Surface=srf, UDivisions=Slider(5, range=2..10), VDivisions=Slider(5, range=2..10), TrussDepth=neg)  # -> LinesA, LinesB, Web, Nodes
default = MaterialDatabaseDefault(CountryCode="S")  # -> SteelMaterial, ConcreteMaterial, TimberMaterial, ReinforcementMaterial, StratumMaterial, CustomMaterial
entwine = Entwine(Branch00=spacetruss_1.LinesA, Branch01=spacetruss_1.LinesB, Branch02=spacetruss_1.Web, FlattenInputs=True)
default_2 = SectionDatabaseDefault()  # -> SteelSection, ConcreteSection, TimberSection, HollowCoreSection, CustomSection
srf_2 = Surface(srf)
list = ValueList({"ordinary", "dead_load", "soil_dead_load", "shrinkage", "prestressing", "fire", "seis_sxp", "seis_sxm", "seis_syp", "seis_sym"}, selected="dead_load")
construct = LoadCaseConstruct(Name="DeadLoad", Type=list, DurationClass="permanent")
item = ListItem(List=default.SteelMaterial, Index=0, Wrap=True)
item_2 = ListItem(List=default_2.SteelSection, Index=0, Wrap=True)
debrep = DeconstructBrep(Brep=srf_2)  # -> Faces, Edges, Vertices
toggle = BooleanToggle(False)
toggle_2 = BooleanToggle(True)
simple = PointSupportSimple(Position=debrep.Vertices, Tx=toggle_2, Ty=toggle_2, Tz=toggle_2, Rx=toggle, Ry=toggle, Rz=toggle, Identifier="S")
beam = BarsBeam(Curve=entwine, Material=item, Section=item_2, OrientLCS=True, Identifier="B")  # -> flatten(Bar)
construct_2 = ModelConstruct(CountryCode="S", StructureElements=flatten([beam, simple]), LoadCases=construct)
open = ModelOpen(FdModel=construct_2, CloseOpenWindows=False, RunNode=Toggle(False))
