# Grasshopper definition unnamed.gh (Grasshopper 1.0.7)
# plug-ins: FEM-Design, FalseStartToggle

default = MaterialDatabaseDefault(CountryCode="S")  # -> SteelMaterial, ConcreteMaterial, TimberMaterial, ReinforcementMaterial, StratumMaterial, CustomMaterial
rectangle = Rectangle(Plane=PlaneXY(0, 0, 0), XSize="-6 to 6", YSize="-6 to 6", Radius=0)  # -> Rectangle, Length
sqgrid = Square(Plane=PlaneXY(0, 0, 0), Size="24", ExtentX=5, ExtentY=5)  # -> Cells, Points
area = Area(Geometry=sqgrid.Cells)  # -> Area, Centroid
item = ListItem(List=default.ConcreteMaterial, Index=0, Wrap=True)
move = Move(Geometry=rectangle.Rectangle, Motion=area.Centroid)  # -> flatten(Geometry), Transform
crv = Curve(move.Geometry)
item_2 = ListItem(List=default.ReinforcementMaterial, Index=0, Wrap=True)
construct = Plate(Surface=crv, Thickness="0.30", Material=item, Identifier="P")
panel = Panel("""x
y""")
panel_2 = Panel("""top
bottom""")
panel_3 = Panel("""0.01
0.04""")
graft = GraftTree(Tree=construct, IncludeEmptyLists=True, IncludeNullItems=True)
graft_2 = GraftTree(Tree=panel, IncludeEmptyLists=True, IncludeNullItems=True)
reinforcementlayout = SurfaceReinforcementLayout(Direction=graft_2, Space=panel_3, Face=panel_2, Cover=0.02)  # -> flatten(Straight)
define = WireDefine(Diameter="0.01", Material=item_2, Profile="ribbed")
graft_3 = GraftTree(Tree=crv, IncludeEmptyLists=True, IncludeNullItems=True)
tstat = TreeStatistics(Tree=graft)  # -> Paths, Length, Count
bysurface = SurfaceReinforcementBySurface(Surface=graft_3, Straight=flatten(reinforcementlayout), Wire=define)  # -> simplify(SurfaceReinforcement)
range = Range(Domain="360", Steps=expr("x", tstat.Count))
X = UnitX(Factor=1)
Z = UnitZ(Factor=1)
cull_i = CullIndex(List=range, Indices="-1", Wrap=True)
vrot = Rotate(Vector=X, Axis=Z, Angle=degrees(cull_i))
Z_2 = UnitZ(Factor=1)
xprod = CrossProduct(VectorA=vrot, VectorB=Z_2, Unitize=False)  # -> Vector, Length
graft_4 = GraftTree(Tree=vrot, IncludeEmptyLists=True, IncludeNullItems=True)
graft_5 = GraftTree(Tree=xprod.Vector, IncludeEmptyLists=True, IncludeNullItems=True)
addtoslab = SurfaceReinforcementAddToSlab(Slab=simplify(graft), SurfaceReinforcement=simplify(bysurface), XDir=simplify(graft_4), YDir=simplify(graft_5))  # -> flatten(Slab)
construct_2 = ModelConstruct(CountryCode="S", StructureElements=flatten(addtoslab))
toggle = FalseStartToggle(True)
open = ModelOpen(FdModel=construct_2, CloseOpenWindows=False, RunNode=toggle)
