# Grasshopper definition 3dprint.gh (Grasshopper 1.0.7)
# plug-ins: Alpaca4d, Weaverbird, FEM-Design, MeshEdit Components

crv = Curve(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)
len = Length(Curve=crv)
panel = Panel("20")
division = Division(A=len, B="0.30")
divide = DivideCurve(Curve=crv, Count=division, Kinks=False)  # -> Points, Tangents, Parameters
pline = PolyLine(Vertices=divide.Points, Closed=invert(False))
division_2 = Division(A="2", B="0.30")
series = Series(Start=0, Step="0.30", Count=division_2)
Z = UnitZ(Factor=series)
move = Move(Geometry=pline, Motion=Z)  # -> Geometry, Transform
ml = MeshLoftAlpaca4d(Polylines=move.Geometry)
default = MaterialDatabaseDefault(CountryCode="S")  # -> SteelMaterial, ConcreteMaterial, TimberMaterial, ReinforcementMaterial, StratumMaterial, CustomMaterial
explode = MeshExplode(Mesh=ml, Interpolate=False)
wbfacepolys = WeaverbirdsFacePolylines(Mesh=explode)  # -> graft(Polygons)
boundary = BoundarySurfaces(Edges=wbfacepolys)
item = ListItem(List=default.ConcreteMaterial, Index=0, Wrap=True)
srf = Surface(flatten(boundary))
explode_2 = Explode(Curve=pline, Recursive=True)  # -> Segments, Vertices
construct = Wall(Surface=srf, Thickness="0.03", Material=item, Identifier="P")
list = ValueList({"ordinary", "dead_load", "soil_dead_load", "shrinkage", "prestressing", "fire", "seis_sxp", "seis_sxm", "seis_syp", "seis_sym"}, selected="dead_load")
data = Data(construct)
rigid = LineSupportRigid(Curve=explode_2.Segments, MovingLocal=False, OrientLCS=True, Identifier="S")
lng = ListLength(List=data)
construct_2 = LoadCaseConstruct(Name="DL", Type=list, DurationClass="permanent")
series_2 = Series(Start=0, Step=1, Count=lng)
addition = Addition(A=series_2, B=1)
graft = GraftTree(Tree=construct, IncludeEmptyLists=True, IncludeNullItems=True)  # -> simplify(Tree)
graft_2 = GraftTree(Tree=rigid, IncludeEmptyLists=True, IncludeNullItems=True)  # -> simplify(Tree)
activatedloadcase = ActivatedLoadCase(LoadCase=construct_2, UFactor=1, ScFactor=1, SfFactor=1, SqFactor=1, Partitioning="from_this_stage_on")
graft_3 = GraftTree(Tree=addition, IncludeEmptyLists=True, IncludeNullItems=True)  # -> simplify(Tree)
merge = Merge(Data1=graft, Data2=graft_2)
stage = Stage(Index=graft_3, Elements=merge, ActivatedLoadCase=activatedloadcase, InitialStressState=False, Day=0)  # -> flatten(Stage)
construct_3 = ModelConstruct(CountryCode="S", StructureElements=flatten([construct, rigid]), LoadCases=construct_2, Stages=stage)
open = ModelOpen(FdModel=construct_3, CloseOpenWindows=Toggle(True), RunNode=Toggle(True))
