# Grasshopper definition optimisation_async.gh (Grasshopper 1.0.7)
# plug-ins: FEM-Design

pt = Point(Point(0, 0, 0))
X = UnitX(Factor=1)
line = LineSDL(Start=pt, Direction=X, Length="12")
genes = GenePool(Decimals=2, Maximum=0.9, Minimum=0.1, Value=[0.34, 0.67])
default = MaterialDatabaseDefault(CountryCode="S")  # -> SteelMaterial, ConcreteMaterial, TimberMaterial, ReinforcementMaterial, StratumMaterial, CustomMaterial
eval = EvaluateCurve(Curve=reparameterize(line), Parameter=genes)  # -> Point, Tangent, Angle
default_2 = SectionDatabaseDefault()  # -> SteelSection, ConcreteSection, TimberSection, HollowCoreSection, CustomSection
list = ValueList({"ordinary", "dead_load", "soil_dead_load", "shrinkage", "prestressing", "fire", "seis_sxp", "seis_sxm", "seis_syp", "seis_sym"}, selected="dead_load")
list_2 = ValueList({"ordinary", "dead_load", "soil_dead_load", "shrinkage", "prestressing", "fire", "seis_sxp", "seis_sxm", "seis_syp", "seis_sym"}, selected="ordinary")
item = ListItem(List=default.SteelMaterial, Index=0, Wrap=True)
end = EndPoints(Curve=line)  # -> Start, End
item_2 = ListItem(List=default_2.SteelSection, Index=0, Wrap=True)
construct = LoadCaseConstruct(Name="DL", Type=list, DurationClass="permanent")
construct_2 = LoadCaseConstruct(Name="IL", Type=list_2, DurationClass="permanent")
hinged = PointSupportHinged(Position=eval.Point, Identifier="S")
rigid = PointSupportRigid(Position=[end.Start, end.End], Identifier="S")
Z = UnitZ(Factor="-10")
force = LineLoadForce(Curve=line, StartForce=Z, LoadCase=construct_2, ConstLoadDir=True, LoadProjection=False)
beam = BarsBeam(Curve=line, Material=item, Section=item_2, OrientLCS=True, Identifier="B")
construct_3 = ModelConstruct(
    CountryCode="S",
    StructureElements=flatten([rigid, hinged, beam]),
    Loads=force,
    LoadCases=flatten([construct, construct_2]))
path = FilePath("C:\Program Files\StruSoft\FEM-Design 22\")
define = AnalysisDefine(
    CalcCase=Toggle(True),
    CalcCstage=False,
    CalcImpf=False,
    CalcComb=Toggle(False),
    CalcGmax=False,
    CalcStab=False,
    CalcFreq=False,
    CalcSeis=False,
    CalcDesign=False,
    CalcFootfall=False,
    Elemfine=False,
    Diaphragm=False,
    PeakSmoothing=False)
connection = FEMDesignConnection(FEMDesignDir=path)
openmodel = FEMDesignOpenModel(Connection=connection, FdModel=construct_3, RunNode=True)  # -> Connection, FdModel, Success
resultstype = ResultsType({"NodalDisplacement", "PointSupportReaction", "PointSupportReactionMinMax", "BarDisplacement", "BarInternalForce", "BarStress", "LineSupportReaction", "LineConnectionResultant", "LineConnectionForce", "SurfaceSupportReaction", "ShellDisplacement", "ShellInternalForce", "ShellStress", "CLTShellUtilization", "CLTFireUtilization", "LabelledSectionInternalForce", "LabelledSectionResultant", "NodalVibrationShape", "EigenFrequencies", "CriticalParameter", "ImperfectionFactor", "QuantityEstimationConcrete", "QuantityEstimationSteel", "QuantityEstimationTimber", "QuantityEstimationTimberPanel", "QuantityEstimationGeneral", "QuantityEstimationReinforcement", "FiniteElement"}, selected="NodalDisplacement")
runanalysis = FEMDesignRunAnalysis(Connection=openmodel.Connection, Analysis=define, RunNode=True)  # -> Connection, Success
getresults = FEMDesignGetResults(Connection=runanalysis.Connection, ResultType=resultstype, RunNode=True)  # -> Connection, Results, Success
nodaldisplacement = NodalDisplacement(Result=getresults.Results, CaseCombinationName="IL")  # -> CaseIdentifier, NodeId, Translation, Rotation
vlen = VectorLength(Vector=nodaldisplacement.Translation)
sort = SortList(Keys=vlen)  # -> Keys, ValuesA
galapagos = Galapagos(fitness=displacement, gene=genes)
sort_2 = SortList(Keys=sort.Keys)  # -> reverse(Keys), ValuesA
item_3 = ListItem(List=sort_2.Keys, Index=0, Wrap=True)
displacement = Number(item_3)
rec = DataRecorder(displacement, DataLimit=-10, RecordData=True)
panel = Panel(displacement)
panel_2 = Panel(rec)
