# Grasshopper definition connection.gh (Grasshopper 1.0.7)
# plug-ins: FEM-Design, Pufferfish, Alpaca4d

srf = Surface([<surface referenced from the Rhino model> x4])
srf_2 = Surface([<surface referenced from the Rhino model> x3])
default = MaterialDatabaseDefault(CountryCode="S")  # -> SteelMaterial, ConcreteMaterial, TimberMaterial, ReinforcementMaterial, StratumMaterial, CustomMaterial
crv = Curve(<curve referenced from the Rhino model>)
Z = UnitZ(Factor="-100")
X = UnitX(Factor="-100")
crv_2 = Curve([<curve referenced from the Rhino model> x8])
explode = Explode(Curve=crv, Recursive=True)  # -> Segments, Vertices
explode_2 = Explode(Curve=crv_2, Recursive=True)  # -> Segments, Vertices
item = ListItem(List=default.SteelMaterial, Index=0, Wrap=True)
construct = LoadCaseConstruct(Name="LL", Type="Ordinary", DurationClass="permanent")
force = LineLoadForce(Curve=explode.Segments, StartForce=X, LoadCase=construct, ConstLoadDir=True, LoadProjection=False)
hinged = LineSupportHinged(Curve=flatten(explode_2.Segments), MovingLocal=False, OrientLCS=True, Identifier="S")
construct_2 = Plate(Surface=srf, Thickness="0.005", Material=item, Identifier="P")
construct_3 = Plate(Surface=srf_2, Thickness="0.005", Material=item, Identifier="P")
construct_4 = ModelConstruct(CountryCode="S", StructureElements=flatten([construct_2, construct_3, hinged]), Loads=force, LoadCases=construct)
path = FilePath("C:\Program Files\StruSoft\FEM-Design 22\")
connection = FEMDesignConnection(FEMDesignDir=path)
openmodel = FEMDesignOpenModel(Connection=connection, FdModel=construct_4, RunNode=True)  # -> Connection, FdModel, Success
define = AnalysisDefine(
    CalcCase=True,
    CalcCstage=False,
    CalcImpf=False,
    CalcComb=Toggle(False),
    CalcGmax=False,
    CalcStab=False,
    CalcFreq=False,
    CalcSeis=False,
    CalcDesign=False,
    CalcFootfall=False,
    Elemfine=False,
    Diaphragm=False,
    PeakSmoothing=False)
runanalysis = FEMDesignRunAnalysis(Connection=openmodel.Connection, Analysis=define, RunNode=Toggle(True))  # -> Connection, Success, Success_2
getfeamodel = FEMDesignGetFeaModel(Connection=runanalysis.Connection, RunNode=True)  # -> Connection, FDFeaModel, Success
resultstype = ResultsType({"NodalDisplacement", "PointSupportReaction", "PointSupportReactionMinMax", "PointConnectionForce", "BarDisplacement", "BarInternalForce", "BarStress", "LineSupportReaction", "LineConnectionResultant", "LineConnectionForce", "SurfaceSupportReaction", "ShellDisplacement", "ShellInternalForce", "ShellStress", "CLTShellUtilization", "CLTFireUtilization", "LabelledSectionInternalForce", "LabelledSectionResultant", "NodalVibrationShape", "EigenFrequencies", "CriticalParameter", "ImperfectionFactor", "QuantityEstimationConcrete", "QuantityEstimationSteel", "QuantityEstimationTimber", "QuantityEstimationTimberPanel", "QuantityEstimationGeneral", "QuantityEstimationReinforcement", "FiniteElement"}, selected="NodalDisplacement")
resultstype_2 = ResultsType({"NodalDisplacement", "PointSupportReaction", "PointSupportReactionMinMax", "PointConnectionForce", "BarDisplacement", "BarInternalForce", "BarStress", "LineSupportReaction", "LineConnectionResultant", "LineConnectionForce", "SurfaceSupportReaction", "ShellDisplacement", "ShellInternalForce", "ShellStress", "CLTShellUtilization", "CLTFireUtilization", "LabelledSectionInternalForce", "LabelledSectionResultant", "NodalVibrationShape", "EigenFrequencies", "CriticalParameter", "ImperfectionFactor", "QuantityEstimationConcrete", "QuantityEstimationSteel", "QuantityEstimationTimber", "QuantityEstimationTimberPanel", "QuantityEstimationGeneral", "QuantityEstimationReinforcement", "FiniteElement"}, selected="ShellDisplacement")
option = ResultOption(Bar="ByStep", Surface="1", Step=0.5)
option_2 = ResultOption(Bar="ByStep", Surface="1", Step=0.5)
units = Units(Length="m", Angle="rad", SectionalData="m", Force="kN", Mass="kg", Displacement="mm", Stress="Pa")
units_2 = Units(Length="m", Angle="rad", SectionalData="m", Force="kN", Mass="kg", Displacement="mm", Stress="Pa")
getresults = FEMDesignGetResults(Connection=getfeamodel.Connection, ResultType=resultstype, CaseName="LL", Options=option, Units=units, RunNode=True)  # -> Connection, Results, Success
getresults_2 = FEMDesignGetResults(
    Connection=getfeamodel.Connection,
    ResultType=resultstype_2,
    CaseName="LL",
    Options=option_2,
    Units=units_2,
    RunNode=True)  # -> Connection, Results, Success
nodaldisplacement = NodalDisplacement(Result=getresults.Results, CaseCombinationName="LL")  # -> CaseIdentifier, NodeId, Translation, Rotation
shelldisplacement = ShellDisplacement(Result=getresults_2.Results, CaseCombinationName="LL")  # -> CaseIdentifier, ElementId, NodeId, Translation, Rotation
feashell = FdFeaModelFeaShell(FdFeaModel=getfeamodel.FDFeaModel)  # -> Identifier, flatten(ElementId), FaceIndex, flatten(MeshGeometry)
sort = SortList(Keys=nodaldisplacement.NodeId, ValuesA=nodaldisplacement.Translation)  # -> Keys, ValuesA
demesh = DeconstructMesh(Mesh=feashell.MeshGeometry)  # -> Vertices, Faces, Colours, Normals
dcon = DeleteConsecutive(Set=sort.Keys, Wrap=False)  # -> Set, Count
cull_i = CullIndex(List=shelldisplacement.NodeId, Indices="-1", Wrap=True)
cull_i_2 = CullIndex(List=shelldisplacement.Translation, Indices="-1", Wrap=True)
item_2 = ListItem(List=sort.ValuesA, Index=dcon.Set, Wrap=True)
vlen = VectorLength(Vector=cull_i_2)
multiplication = Multiplication(A=cull_i_2, B=Slider(1, range=0..1))
bnd = Bounds(Numbers=flatten(vlen))
translation = Data(item_2)
id = Data(dcon.Set)
move = Move(Geometry=demesh.Vertices, Motion=multiplication)  # -> Geometry, Transform
remap = RemapNumbers(Value=vlen, Source=bnd, Target=Domain(0, 1))  # -> Mapped, Clipped
clr = ColorsAlpaca4d(GradientIndex=Slider(12, range=0..12))
twnthrucols = TweenThroughColors(
    Colors=clr,
    Factor=remap.Mapped,
    Normalized=True,
    Equalized=False,
    Weighted=False,
    Loopback=False,
    Degree=3,
    InterpolationType=0,
    Alpha=True)
conmesh = ConstructMesh(Vertices=move.Geometry, Faces=demesh.Faces, Colours=twnthrucols)
