# Grasshopper definition parametric_connection.gh (Grasshopper 1.0.7)
# plug-ins: FEM-Design

xz = XZPlane(Origin=Point(0, 0, 0))
rectangle = Rectangle(Plane=xz, XSize="0.30", YSize="0.60", Radius=0)  # -> Rectangle, Length
deplane = DeconstructPlane(Plane=xz)  # -> Origin, XAxis, YAxis, ZAxis
multiplication = Multiplication(A=deplane.ZAxis, B="2")
move = Move(Geometry=rectangle.Rectangle, Motion=multiplication)  # -> Geometry, Transform
merge = Merge(Data1=rectangle.Rectangle, Data2=move.Geometry)
loft = Loft(Curves=merge, Options={Adjust=False, Closed=False, LoftEnds=0, LoftSimp=0, LoftType=0, Rebuild=10, Refit=0.01})
debrep = DeconstructBrep(Brep=loft)  # -> Faces, Edges, Vertices
md_slider = MDSlider(SliderMode=0, slider_value=Point(0.5, 0.5, 0.5), x_domain=Domain(0, 1), y_domain=Domain(0, 1), z_domain=Domain(0, 1))
item = ListItem(List=debrep.Faces, Index=0, Wrap=True)
evalsrf = EvaluateSurface(Surface=reparameterize(item), Point=md_slider)  # -> Point, Normal, UDirection, VDirection, Frame
division = Division(A="0.20", B="2")
division_2 = Division(A="0.50", B="2")
neg = Negative(Value=division)
neg_2 = Negative(Value=division_2)
pln = Plane(evalsrf.Frame)
dom = ConstructDomain(DomainStart=neg, DomainEnd=division)
dom_2 = ConstructDomain(DomainStart=neg_2, DomainEnd=division_2)
pflip = FlipPlane(Plane=pln, ReverseX=False, ReverseY=False, SwapAxes=True)
rectangle_2 = Rectangle(Plane=pln, XSize=dom, YSize=dom_2, Radius=0)  # -> Rectangle, Length
deplane_2 = DeconstructPlane(Plane=pflip)  # -> Origin, XAxis, YAxis, ZAxis
max = Maximum(A="0.20", B="0.50")
multiplication_2 = Multiplication(A=deplane_2.ZAxis, B=max)
move_2 = Move(Geometry=rectangle_2.Rectangle, Motion=multiplication_2)  # -> Geometry, Transform
merge_2 = Merge(Data1=rectangle_2.Rectangle, Data2=move_2.Geometry)
edges = BrepEdges(Brep=loft)  # -> Naked, Interior, NonManifold
loft_2 = Loft(Curves=merge_2, Options={Adjust=False, Closed=False, LoftEnds=0, LoftSimp=0, LoftType=0, Rebuild=10, Refit=0.01})
crv = Curve(edges.Naked)
debrep_2 = DeconstructBrep(Brep=loft_2)  # -> Faces, Edges, Vertices
hinged = LineSupportHinged(Curve=crv, MovingLocal=False, OrientLCS=True, Identifier="S")
crv_2 = Curve(move_2.Geometry)
default = MaterialDatabaseDefault(CountryCode="S")  # -> SteelMaterial, ConcreteMaterial, TimberMaterial, ReinforcementMaterial, StratumMaterial, CustomMaterial
srf = Surface(debrep.Faces)
join = JoinCurves(Curves=crv_2, Preserve=False)
srf_2 = Surface(debrep_2.Faces)
explode = Explode(Curve=join, Recursive=True)  # -> Segments, Vertices
list = ValueList({"ordinary", "dead_load", "soil_dead_load", "shrinkage", "prestressing", "fire", "seis_sxp", "seis_sxm", "seis_syp", "seis_sym"}, selected="ordinary")
Z = UnitZ(Factor="-100")
item_2 = ListItem(List=default.SteelMaterial, Index=0, Wrap=True)
construct = LoadCaseConstruct(Name="LL", Type=list, DurationClass="permanent")
force = LineLoadForce(Curve=explode.Segments, StartForce=Z, LoadCase=construct, ConstLoadDir=True, LoadProjection=False)
construct_2 = Plate(Surface=srf_2, Thickness="0.005", Material=item_2, Identifier="P")
construct_3 = Plate(Surface=srf, Thickness="0.005", Material=item_2, Identifier="P")
connection = FEMDesignConnection()
construct_4 = ModelConstruct(CountryCode="S", StructureElements=flatten([construct_2, construct_3]), Loads=force, LoadCases=construct)
openmodel = FEMDesignOpenModel(Connection=connection, FdModel=construct_4, RunNode=True)  # -> Connection, FdModel, Success
