# Grasshopper definition stressPattern.gh (Grasshopper 1.0.7)
# plug-ins: FEM-Design, Pufferfish, Human

xz_plane = XZPlane(Origin=Point(0, 0, 0))
materialdatabase_default = MaterialDatabaseDefault(CountryCode="S")  # -> SteelMaterial, ConcreteMaterial, TimberMaterial, ReinforcementMaterial, StratumMaterial, CustomMaterial
rectangle = Rectangle(Plane=xz_plane, XSize="10", YSize=Slider(5, range=0..10), Radius=0)  # -> Rectangle, Length
list_item = ListItem(List=materialdatabase_default.SteelMaterial, Index=0, Wrap=True)
md_slider = MDSlider(SliderMode=0, slider_value=Point(0.5, 0.5, 0.5), x_domain=Domain(0, 1), y_domain=Domain(0, 1), z_domain=Domain(0, 1))
evaluate_surface = EvaluateSurface(Surface=rectangle.Rectangle, Point=md_slider)  # -> Point, Normal, UDirection, VDirection, Frame
plate = Plate(Surface=rectangle.Rectangle, Thickness="0.15", Material=list_item, Identifier="P")
deconstruct_brep = DeconstructBrep(Brep=rectangle.Rectangle)  # -> Faces, Edges, Vertices
list_item_2 = ListItem(List=deconstruct_brep.Edges, Index=0, Wrap=True)
loadcase_construct = LoadCaseConstruct(Name="myCase", Type="Ordinary", DurationClass="permanent")
multiplication = Multiplication(A=evaluate_surface.Normal, B="10")
linesupport_rigid = LineSupportRigid(Curve=list_item_2, MovingLocal=False, OrientLCS=True, Identifier="S")
surfaceload_uniform = SurfaceLoadUniform(Surface=rectangle.Rectangle, Force=multiplication, LoadCase=loadcase_construct)
slab_averagesurfaceelementsize = SlabAverageSurfaceElementSize(Slab=plate, AverageSurfaceElementSize="0.20")
loadcombination_construct = LoadCombinationConstruct(Name="ULS", Type="ultimate_ordinary", LoadCase=loadcase_construct, Gamma="1.0")
model_construct = ModelConstruct(
    CountryCode="S",
    StructureElements=[slab_averagesurfaceelementsize, linesupport_rigid],
    Loads=surfaceload_uniform,
    LoadCases=loadcase_construct,
    LoadCombinations=loadcombination_construct)
fem_design_openmodel = FEMDesignOpenModel(Model=model_construct, RunNode=True)  # -> Connection, Model, Success
analysis_define = AnalysisDefine(
    CalcCase=True,
    CalcCstage=False,
    CalcImpf=False,
    CalcComb=True,
    CalcGmax=False,
    CalcStab=False,
    CalcFreq=False,
    CalcSeis=False,
    CalcDesign=False,
    CalcFootfall=False,
    Elemfine=False,
    Diaphragm=False,
    PeakSmoothing=False)
fem_design_runanalysis = FEMDesignRunAnalysis(Connection=fem_design_openmodel.Connection, Analysis=analysis_define, RunNode=True)  # -> Connection, Log, Success
resultstype = ResultsType({"NodalDisplacement", "PointSupportReaction", "PointSupportReactionMinMax", "PointConnectionForce", "BarDisplacement", "BarInternalForce", "BarStress", "LineSupportReaction", "LineConnectionResultant", "LineConnectionForce"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}, selected="ShellStress")
fem_design_getfemodel = FEMDesignGetFeModel(Connection=fem_design_runanalysis.Connection, RunNode=True)  # -> Connection, FiniteElement, Success
resultoption = ResultOption(Bar="ByStep", Surface="0", Step=0.5)
fem_design_getresults = FEMDesignGetResults(Connection=fem_design_runanalysis.Connection, ResultType=resultstype, Options=resultoption, RunNode=True)  # -> Connection, Results, Success
value_list = ValueList({"top", "bottom", "membrane"}, selected="bottom")
finiteelement_femshell = FiniteElementFemShell(FiniteElement=fem_design_getfemodel.FiniteElement)  # -> Identifier, ElementId, FaceIndex, Mesh
shellstress = ShellStress(Result=fem_design_getresults.Results, CaseCombinationName="ULS", Side=value_list)  # -> CaseIdentifier, ElementId, NodeId, SigmaX, SigmaY, TauXY, TauXZ, TauYZ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
face_normals = FaceNormals(Mesh=finiteelement_femshell.Mesh)  # -> Centers, Normals
plane_normal = PlaneNormal(Origin=face_normals.Centers, ZAxis=face_normals.Normals)  # -> flatten(Plane)
list_item_3 = ListItem(List=shellstress.Sigma2, Index=0, Wrap=True)  # -> flatten(Item)
bounds = Bounds(Numbers=list_item_3)
construct_domain = ConstructDomain(DomainStart="0.01", DomainEnd="0.08")
remap_numbers = RemapNumbers(Value=list_item_3, Source=bounds, Target=construct_domain)  # -> Mapped, Clipped
area = Area(Geometry=rectangle.Rectangle)  # -> Area, Centroid
circle = Circle(Plane=plane_normal, Radius=remap_numbers.Mapped)
remap_numbers_2 = RemapNumbers(Value=remap_numbers.Mapped, Source=construct_domain, Target=Domain(0, 1))  # -> Mapped, Clipped
merge = Merge(Data1=ColourSwatch(SwatchColor=RGB(27, 83, 143)), Data3=ColourSwatch(SwatchColor=RGB(255, 255, 255)))
scale = Scale(Geometry=rectangle.Rectangle, Center=area.Centroid, Factor="1.01")  # -> Geometry, Transform
tween_through_colors = TweenThroughColors(
    Colors=merge,
    Factor=remap_numbers_2.Mapped,
    Normalized=True,
    Equalized=False,
    Weighted=False,
    Loopback=False,
    Degree=3,
    InterpolationType=0,
    Alpha=True)
surface_split = SurfaceSplit(Surface=scale.Geometry, Curves=circle)
custom_preview_lineweights = CustomPreviewLineweights(Geometry=circle, Shader=ColourSwatch(SwatchColor=RGB(27, 83, 143)), Thickness="2", Absolute=False)
graft_tree = GraftTree(Tree=finiteelement_femshell.Mesh, IncludeEmptyLists=True, IncludeNullItems=True)
graft_tree_2 = GraftTree(Tree=tween_through_colors, IncludeEmptyLists=True, IncludeNullItems=True)
list_item_4 = ListItem(List=surface_split, Index=0, Wrap=True)
mesh_colours = MeshColours(Mesh=graft_tree, Colours=graft_tree_2)
unit_z = UnitZ(Factor="-6.0")
move = Move(Geometry=mesh_colours, Motion=unit_z)  # -> Geometry, Transform
materialdatabase_default_2 = MaterialDatabaseDefault(CountryCode="S")  # -> SteelMaterial, ConcreteMaterial, TimberMaterial, ReinforcementMaterial, StratumMaterial, CustomMaterial
md_slider_2 = MDSlider(SliderMode=0, slider_value=Point(0.5, 0.5, 0.5), x_domain=Domain(0, 1), y_domain=Domain(0, 1), z_domain=Domain(0, 1))
list_item_5 = ListItem(List=materialdatabase_default_2.SteelMaterial, Index=0, Wrap=True)
evaluate_surface_2 = EvaluateSurface(Surface=rectangle.Rectangle, Point=md_slider_2)  # -> Point, Normal, UDirection, VDirection, Frame
deconstruct_brep_2 = DeconstructBrep(Brep=scale.Geometry)  # -> Faces, Edges, Vertices
plate_2 = Plate(Surface=list_item_4, Thickness="0.05", Material=list_item_5, Identifier="P")
list_item_6 = ListItem(List=deconstruct_brep_2.Edges, Index=0, Wrap=True)
loadcase_construct_2 = LoadCaseConstruct(Name="myCase", Type="Ordinary", DurationClass="permanent")
multiplication_2 = Multiplication(A=evaluate_surface_2.Normal, B="10")
linesupport_rigid_2 = LineSupportRigid(Curve=list_item_6, MovingLocal=False, OrientLCS=True, Identifier="S")
surfaceload_uniform_2 = SurfaceLoadUniform(Surface=rectangle.Rectangle, Force=multiplication_2, LoadCase=loadcase_construct_2)
loadcombination_construct_2 = LoadCombinationConstruct(Name="ULS", Type="ultimate_ordinary", LoadCase=loadcase_construct_2, Gamma="1.0")
model_construct_2 = ModelConstruct(
    CountryCode="S",
    StructureElements=flatten([plate_2, linesupport_rigid_2]),
    Loads=surfaceload_uniform_2,
    LoadCases=loadcase_construct_2,
    LoadCombinations=loadcombination_construct_2)
fem_design_openmodel_2 = FEMDesignOpenModel(Model=model_construct_2, RunNode=True)  # -> Connection, Model, Success
