# Grasshopper definition intSurface_OnSection_Advance.gh (Grasshopper 1.0.7)
# plug-ins: FEM-Design, eleFront

panel = Panel("""0
1
2""")
format = Format(Format="Section_{0}::*", Culture=127, Data0=panel)
reference_by_layer = ReferenceByLayer(LayerName=format, lightweight=False, DisableAutoUpdate=True)
value_list = ValueList({"Point", "Curve", "Arc", "Circle", "Ellipse", "Line", "Polyline", "Brep", "Surface", "Polysurface", "Extrusion", "Block", "Text", "TextDot", "Dimension", "LinearDimension", "AngularDimension", "RadialDimension", "Hatch", "Leader"}, selected="Point")
value_list_2 = ValueList({"Point", "Curve", "Arc", "Circle", "Ellipse", "Line", "Polyline", "Brep", "Surface", "Polysurface", "Extrusion", "Block", "Text", "TextDot", "Dimension", "LinearDimension", "AngularDimension", "RadialDimension", "Hatch", "Leader"}, selected="Curve")
value_list_3 = ValueList({"Point", "Curve", "Arc", "Circle", "Ellipse", "Line", "Polyline", "Brep", "Surface", "Polysurface", "Extrusion", "Block", "Text", "TextDot", "Dimension", "LinearDimension", "AngularDimension", "RadialDimension", "Hatch", "Leader"}, selected="Surface")
filter_by_type = FilterByType(ObjectType=value_list_3, Geometry=reference_by_layer, invertFilter=False, returnNulls=False)  # -> ExcludedGeometry, IncludedGeometry
filter_by_type_2 = FilterByType(ObjectType=value_list, Geometry=reference_by_layer, invertFilter=False, returnNulls=False)  # -> ExcludedGeometry, IncludedGeometry
filter_by_type_3 = FilterByType(ObjectType=value_list_2, Geometry=reference_by_layer, invertFilter=False, returnNulls=False)  # -> ExcludedGeometry, IncludedGeometry
path = FilePath("C:\Users\Marco\OneDrive - StruSoft AB\FD API\Resources\materialLibrary\materials_S.struxml")
fromstruxml = MaterialDatabaseFromStruxml(FilePath=path)  # -> SteelMaterial, ConcreteMaterial, TimberMaterial, ReinforcementMaterial, StratumMaterial, CustomMaterial
item = ListItem(List=fromstruxml.ReinforcementMaterial, Index=0, Wrap=True)
item_2 = ListItem(List=fromstruxml.ConcreteMaterial, Index="6", Wrap=True)
reinf_material = Data(item)
reinf_material_2 = Data(item)
concrete_material = Data(item_2)
wire_define = WireDefine(Diameter="0.025", Material=reinf_material, Profile="ribbed")
surface = Surface(filter_by_type.IncludedGeometry)
point = Point(filter_by_type_2.IncludedGeometry)
curve = Curve(filter_by_type_3.IncludedGeometry)
wire_define_2 = WireDefine(Diameter="0.02", Material=reinf_material_2, Profile="ribbed")
patch = Patch(Surface=surface, Material=concrete_material)  # -> simplify(Patch)
layer = Layer(Curve=curve, NumberOfRebar="5", Wire=wire_define)  # -> simplify(Layer)
rebar = Rebar(Point=point, Wire=wire_define_2)  # -> simplify(Rebar)
panel_2 = Panel(layer)
interactionsurface_onsection = InteractionSurfaceOnSection(Patch=patch, Rebars=rebar, Layers=layer, FUlt=True)  # -> InteractionSurface, N, My, Mz, Bar; disabled
panel_3 = Panel(interactionsurface_onsection.N)
panel_4 = Panel(interactionsurface_onsection.My)
panel_5 = Panel(interactionsurface_onsection.Mz)
mesh = Mesh(interactionsurface_onsection.InteractionSurface)
bar = Data(interactionsurface_onsection.Bar)
model_construct = ModelConstruct(CountryCode="S", StructureElements=bar)  # disabled
boolean_toggle = BooleanToggle(True)  # disabled
boolean_toggle_2 = BooleanToggle(False)  # disabled
model_open = ModelOpen(Model=model_construct, CloseOpenWindows=boolean_toggle, RunNode=boolean_toggle_2)  # disabled
