# Grasshopper definition truss_design_group.gh (Grasshopper 1.0.7)
# plug-ins: BullAnt, FEM-Design, Kangaroo2 Components

curve = Curve(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)
curve_2 = Curve(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)
ggtrussfromcurves = GgTrussFromCurves(
    FirstCurve=curve_2,
    SecondCurve=curve,
    NumberDivision=Slider(10, range=2..20),
    TrussType=Slider(4, range=0..5),
    Frames=False)  # -> ChordACurves, ChordBCurves, Diagonals, Verticals
end_points = EndPoints(Curve=[curve_2, curve])  # -> Start, End
curve_3 = Curve(ggtrussfromcurves.ChordACurves)
join_curves = JoinCurves(Curves=curve_3, Preserve=False)
explode = Explode(Curve=join_curves, Recursive=True)  # -> Segments, Vertices
materialdatabase_default = MaterialDatabaseDefault(CountryCode="S")  # -> SteelMaterial, ConcreteMaterial, TimberMaterial, ReinforcementMaterial, StratumMaterial, CustomMaterial
curve_4 = Curve(ggtrussfromcurves.ChordBCurves)
curve_5 = Curve(ggtrussfromcurves.Diagonals)
curve_6 = Curve(ggtrussfromcurves.Verticals)
sectiondatabase_default = SectionDatabaseDefault()  # -> SteelSection, ConcreteSection, TimberSection, HollowCoreSection, CustomSection
removeduplicatepts = RemoveDuplicatePts(Points=explode.Vertices, Tolerance=0.01)
value_list = ValueList({"ordinary", "dead_load", "soil_dead_load", "shrinkage", "prestressing", "fire", "seis_sxp", "seis_sxm", "seis_syp", "seis_sym"}, selected="ordinary")
value_list_2 = ValueList({"permanent", "long-term", "medium-term", "short-term", "instantaneous"}, selected="permanent")
value_list_3 = ValueList({"ordinary", "dead_load", "soil_dead_load", "shrinkage", "prestressing", "fire", "seis_sxp", "seis_sxm", "seis_syp", "seis_sym"}, selected="dead_load")
value_list_4 = ValueList({"permanent", "long-term", "medium-term", "short-term", "instantaneous"}, selected="permanent")
removeduplicatepts_2 = RemoveDuplicatePts(Points=[end_points.Start, end_points.End], Tolerance=0.01)
boolean_toggle = BooleanToggle(True)
unit_z = UnitZ(Factor="-50")
loadcase_construct = LoadCaseConstruct(Name="LL", Type=value_list, DurationClass=value_list_2)
list_item = ListItem(List=sectiondatabase_default.SteelSection, Index=0, Wrap=True)
loadcase_construct_2 = LoadCaseConstruct(Name="DL", Type=value_list_3, DurationClass=value_list_4)
list_item_2 = ListItem(List=materialdatabase_default.SteelMaterial, Index=0, Wrap=True)
pointsupport_simple = PointSupportSimple(
    Position=removeduplicatepts_2,
    Tx=True,
    Ty=True,
    Tz=True,
    Rx=boolean_toggle,
    Ry=boolean_toggle,
    Rz=boolean_toggle,
    Identifier="S")
value_list_5 = ValueList({"ultimate_ordinary", "ultimate_accidental", "ultimate_seismic", "serviceability_quasi_permanent", "serviceability_frequent", "serviceability_characteristic"}, selected="ultimate_ordinary")
merge = Merge(Data1=loadcase_construct_2, Data2=loadcase_construct)
panel = Panel("""1.35
1.5""")
bars_beam = BarsBeam(Curve=curve_3, Material=list_item_2, Section=list_item, OrientLCS=True, Identifier="B")
bars_beam_2 = BarsBeam(Curve=curve_4, Material=list_item_2, Section=list_item, OrientLCS=True, Identifier="B")
bars_beam_3 = BarsBeam(Curve=curve_5, Material=list_item_2, Section=list_item, OrientLCS=True, Identifier="B")
bars_beam_4 = BarsBeam(Curve=curve_6, Material=list_item_2, Section=list_item, OrientLCS=True, Identifier="B")
pointload_force = PointLoadForce(Point=removeduplicatepts, Force=unit_z, LoadCase=loadcase_construct)
loadcombination_construct = LoadCombinationConstruct(Name="ULS_DL", Type=value_list_5, LoadCase=merge, Gamma=panel)  # -> flatten(LoadCombination)
model_construct = ModelConstruct(
    CountryCode="S",
    StructureElements=flatten([bars_beam, bars_beam_2, bars_beam_3, pointsupport_simple, bars_beam_4]),
    Loads=pointload_force,
    LoadCases=merge,
    LoadCombinations=loadcombination_construct)
connection = FEMDesignConnection(DeleteOutputFolder=False)
fem_design_openmodel = FEMDesignOpenModel(Connection=connection, Model=model_construct, RunNode=True)  # -> Connection, Model, Success
partition_list = PartitionList(List=bars_beam_3, Size="2")
entwine = Entwine(Branch0X=bars_beam, Branch1X=bars_beam_2, Branch2X=partition_list, Branch3X=bars_beam_4, FlattenInputs=False)  # -> simplify(Result)
filter = StreamFilter(Gate=fem_design_openmodel.Success, Stream1=entwine)
data = Data(filter)
tree_statistics = TreeStatistics(Tree=data)  # -> Paths, Length, Count
panel_2 = Panel("""a
b
c
d
e
f
g
h
j
k
l
p
o
i
u
y""")
define = AnalysisDefine(
    CalcCase=True,
    CalcCstage=False,
    CalcImpf=False,
    CalcComb=True,
    CalcGmax=False,
    CalcStab=False,
    CalcFreq=False,
    CalcSeis=False,
    CalcDesign=False,
    CalcFootfall=False,
    Elemfine=False,
    Diaphragm=False,
    PeakSmoothing=False)
series = Series(Start=0, Step=1, Count=tree_statistics.Count)
list_item_3 = ListItem(List=panel_2, Index=series, Wrap=True)
runanalysis = FEMDesignRunAnalysis(Connection=fem_design_openmodel.Connection, Analysis=define, RunNode=Toggle(True))  # -> Connection, Log, Success
graft_tree = GraftTree(Tree=list_item_3, IncludeEmptyLists=True, IncludeNullItems=True)
designgroup = DesignGroup(GroupName=graft_tree, StructuralElements=data)  # -> flatten(DesignGroup)
design_define = DesignDefine(AutoDesign=Toggle(False), Check=True, BasedOn=True, ApplyChanges=Toggle(True))
fem_design_rundesign = FEMDesignRunDesign(Connection=runanalysis.Connection, Mode="steel", Design=design_define, DesignGroup=designgroup, RunNode=Toggle(True))  # -> Connection, Success
rundesign = FEMDesignRunDesign(RunNode=True)  # -> Connection, Success
resultstype = ResultsType({"NodalDisplacement", "PointSupportReaction", "PointSupportReactionMinMax", "PointConnectionForce", "BarDisplacement", "BarInternalForce", "BarStress", "LineSupportReaction", "LineConnectionResultant", "LineConnectionForce"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}, selected="QuantityEstimationSteel")
resultstype_2 = ResultsType({"NodalDisplacement", "PointSupportReaction", "PointSupportReactionMinMax", "PointConnectionForce", "BarDisplacement", "BarInternalForce", "BarStress", "LineSupportReaction", "LineConnectionResultant", "LineConnectionForce"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}, selected="BarSteelUtilization")
fem_design_getquantities = FEMDesignGetQuantities(Connection=fem_design_rundesign.Connection, QuantityType=resultstype, RunNode=True)  # -> Connection, Quantities, Success
steelquantityestimation = SteelQuantityEstimation(Result=fem_design_getquantities.Quantities)  # -> Storey, Structure, Id, Quality, Section, UnitWeight, Subtotal, TotalWeight, PaintedArea
getresults = FEMDesignGetResults(Connection=fem_design_rundesign.Connection, ResultType=resultstype_2, RunNode=True)  # -> Connection, Results, Success
panel_3 = Panel(steelquantityestimation.TotalWeight)
panel_4 = Panel(getresults.Results)
