# Grasshopper definition big_truss.gh (Grasshopper 1.0.7)
# plug-ins: LunchBox, LunchBoxML, FEM-Design, Human, BH.UI.Grasshopper

number_slider = Slider(10, range=5..10)
srf = Surface(<surface referenced from the Rhino model>)
spacetruss_1 = SpaceTrussStructure1(Surface=srf, UDivisions=number_slider, VDivisions=Slider(6, range=5..10), TrussDepth=Slider(1.73, range=0.1..3))  # -> LinesA, LinesB, Web, Nodes
crv = Curve(spacetruss_1.Web)
midpt = CurveMiddle(Curve=crv)

vec = Vector(midpt)
devec = DeconstructVector(Vector=vec)  # -> XComponent, YComponent, ZComponent
entwine = Entwine(Branch00=devec.XComponent, Branch01=devec.YComponent, Branch02=devec.ZComponent, FlattenInputs=True)
flip = FlipMatrix(Data=devec.YComponent)
k_means = KMeansClustering(TrainingInputs=simplify(flip), OfClusters=number_slider, RandomSeed=5)  # -> Result, Likelihood, Centroids
cset = CreateSet(List=k_means.Result)  # -> Set, Map
mindex = MemberIndex(Set=k_means.Result, Member=cset.Set)  # -> Index, Count
item = ListItem(List=crv, Index=mindex.Index, Wrap=True)

crv_2 = Curve(spacetruss_1.LinesA)
vec_2 = Vector(crv_2)
devec_2 = DeconstructVector(Vector=vec_2)  # -> XComponent, YComponent, ZComponent
entwine_2 = Entwine(Branch00=devec_2.XComponent, Branch01=devec_2.YComponent, Branch02=devec_2.ZComponent, FlattenInputs=True)
flip_2 = FlipMatrix(Data=entwine_2)
k_means_2 = KMeansClustering(TrainingInputs=simplify(flip_2), OfClusters=2, RandomSeed=5)  # -> Result, Likelihood, Centroids
cset_2 = CreateSet(List=k_means_2.Result)  # -> Set, Map
mindex_2 = MemberIndex(Set=k_means_2.Result, Member=cset_2.Set)  # -> Index, Count
item_2 = ListItem(List=crv_2, Index=mindex_2.Index, Wrap=True)

crv_3 = Curve(spacetruss_1.LinesB)
vec_3 = Vector(crv_3)
devec_3 = DeconstructVector(Vector=vec_3)  # -> XComponent, YComponent, ZComponent
entwine_3 = Entwine(Branch00=devec_3.XComponent, Branch01=devec_3.YComponent, Branch02=devec_3.ZComponent, FlattenInputs=True)
flip_3 = FlipMatrix(Data=entwine_3)
k_means_3 = KMeansClustering(TrainingInputs=simplify(flip_3), OfClusters=2, RandomSeed=5)  # -> Result, Likelihood, Centroids
cset_3 = CreateSet(List=k_means_3.Result)  # -> Set, Map
mindex_3 = MemberIndex(Set=k_means_3.Result, Member=cset_3.Set)  # -> Index, Count
item_3 = ListItem(List=crv_3, Index=mindex_3.Index, Wrap=True)

value_list = ValueList({"ordinary", "dead_load", "soil_dead_load", "shrinkage", "prestressing", "fire", "seis_sxp", "seis_sxm", "seis_syp", "seis_sym"}, selected="ordinary")
value_list_2 = ValueList({"permanent", "long-term", "medium-term", "short-term", "instantaneous"}, selected="permanent")
value_list_3 = ValueList({"ordinary", "dead_load", "soil_dead_load", "shrinkage", "prestressing", "fire", "seis_sxp", "seis_sxm", "seis_syp", "seis_sym"}, selected="dead_load")
value_list_4 = ValueList({"permanent", "long-term", "medium-term", "short-term", "instantaneous"}, selected="permanent")
unit_z = UnitZ(Factor="-50")
pt = Point(spacetruss_1.Nodes)
loadcase_construct = LoadCaseConstruct(Name="LL", Type=value_list, DurationClass=value_list_2)
loadcase_construct_2 = LoadCaseConstruct(Name="DL", Type=value_list_3, DurationClass=value_list_4)
value_list_5 = ValueList({"ultimate_ordinary", "ultimate_accidental", "ultimate_seismic", "serviceability_quasi_permanent", "serviceability_frequent", "serviceability_characteristic"}, selected="ultimate_ordinary")
merge = Merge(Data1=loadcase_construct_2, Data2=loadcase_construct)
panel = Panel("""1.35
1.5""")
default = MaterialDatabaseDefault(CountryCode="S")  # -> SteelMaterial, ConcreteMaterial, TimberMaterial, ReinforcementMaterial, StratumMaterial, CustomMaterial
default_2 = SectionDatabaseDefault()  # -> SteelSection, ConcreteSection, TimberSection, HollowCoreSection, CustomSection
pointload_force = PointLoadForce(Point=pt, Force=unit_z, LoadCase=loadcase_construct)
loadcombination_construct = LoadCombinationConstruct(Name="ULS_DL", Type=value_list_5, LoadCase=merge, Gamma=panel)  # -> flatten(LoadCombination)
item_4 = ListItem(List=default.SteelMaterial, Index=0, Wrap=True)
item_5 = ListItem(List=default_2.SteelSection, Index="408", Wrap=True)
loadcombinations = Data(loadcombination_construct)
loadcases = Data([loadcase_construct_2, loadcase_construct])
loads = Data(pointload_force)
debrep = DeconstructBrep(Brep=srf)  # -> Faces, Edges, Vertices
simple = PointSupportSimple(PointPlane=debrep.Vertices, Tx=True, Ty=True, Tz=True, Rx=True, Ry=True, Rz=True, Identifier="S")
beam = BarsBeam(Curve=item_2, Material=item_4, Section=item_5, OrientLCS=True, Identifier="B")
beam_2 = BarsBeam(Curve=item_3, Material=item_4, Section=item_5, OrientLCS=True, Identifier="B")
beam_3 = BarsBeam(Curve=item, Material=item_4, Section=item_5, OrientLCS=True, Identifier="B")
entwine_4 = Entwine(Branch0X=beam, Branch1X=beam_2, Branch2X=beam_3, FlattenInputs=False)
construct = ModelConstruct(
    CountryCode="S",
    StructureElements=flatten([entwine_4, simple]),
    Loads=loads,
    LoadCases=loadcases,
    LoadCombinations=loadcombinations)
connection = FEMDesignConnection(DeleteOutputFolder=False)
deconstruct = ModelDeconstruct(Model=construct)  # -> CountryCode, Foundations, Bars, FictitiousBars, Shells, FictitiousShells, Diaphragms, LabelledSection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
openmodel = FEMDesignOpenModel(Connection=connection, Model=construct, RunNode=True)  # -> Connection, Model, Success
unflatten = UnflattenTree(Tree=deconstruct.Bars, Guide=entwine_4)
define = AnalysisDefine(
    CalcCase=True,
    CalcCstage=False,
    CalcImpf=False,
    CalcComb=True,
    CalcGmax=False,
    CalcStab=False,
    CalcFreq=False,
    CalcSeis=False,
    CalcDesign=False,
    CalcFootfall=False,
    Elemfine=False,
    Diaphragm=False,
    PeakSmoothing=False)
tstat = TreeStatistics(Tree=simplify(unflatten))  # -> Paths, Length, Count
runanalysis = FEMDesignRunAnalysis(Connection=openmodel.Connection, Analysis=define, RunNode=True)  # -> Connection, Log, Success
graft = GraftTree(Tree=tstat.Paths, IncludeEmptyLists=True, IncludeNullItems=True)
define_2 = DesignDefine(AutoDesign=Toggle(True), Check=Toggle(False), BasedOn=True, ApplyChanges=Toggle(True))
designgroup = DesignGroup(GroupName=graft, StructuralElements=unflatten)  # -> flatten(DesignGroup)
rundesign = FEMDesignRunDesign(Connection=runanalysis.Connection, Mode="Steel", Design=define_2, DesignGroup=designgroup, RunNode=True)  # -> Connection, Success
data = Data(define)
runanalysis_2 = FEMDesignRunAnalysis(Connection=rundesign.Connection, Analysis=data, RunNode=True)  # -> Connection, Log, Success
item_6 = ListItem(List=loadcombinations, Index=0, Wrap=True)
imperfection = ImperfectionDefine(LoadCombination=item_6, Amplitude="0.401", PositiveOnly=False, NumIterations=20)
stability = StabilityDefine(LoadCombination=item_6, NumShapes="10", PositiveOnly=False, NumIterations=20)
toggle = BooleanToggle(False)
define_3 = AnalysisDefine(
    Stability=stability,
    Imperfection=imperfection,
    CalcCase=toggle,
    CalcCstage=False,
    CalcImpf=Toggle(True),
    CalcComb=toggle,
    CalcGmax=False,
    CalcStab=Toggle(False),
    CalcFreq=False,
    CalcSeis=False,
    CalcDesign=False,
    CalcFootfall=False,
    Elemfine=False,
    Diaphragm=False,
    PeakSmoothing=False)
define_4 = DesignDefine(AutoDesign=Toggle(False), Check=Toggle(True), BasedOn=True, ApplyChanges=Toggle(False))
rundesign_2 = FEMDesignRunDesign(Connection=runanalysis_2.Connection, Mode="Steel", Design=define_4, RunNode=True)  # -> Connection, Success
runanalysis_3 = FEMDesignRunAnalysis(Connection=rundesign_2.Connection, Analysis=define_3, RunNode=True)  # -> Connection, Log, Success
getresults = FEMDesignGetResults(Connection=runanalysis_3.Connection, ResultType="ImperfectionFactor", RunNode=True)  # -> Connection, Results, Success
panel_2 = Panel(getresults.Results)
resultstype = ResultsType({"NodalDisplacement", "NodalDisplacement", "PointSupportReaction", "PointSupportReactionMinMax", "PointConnectionForce", "BarDisplacement", "BarInternalForce", "BarStress", "LineSupportReaction", "LineConnectionResultant"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}, selected="BarSteelUtilization")  # disabled
resultstype_2 = ResultsType({"NodalDisplacement", "NodalDisplacement", "PointSupportReaction", "PointSupportReactionMinMax", "PointConnectionForce", "BarDisplacement", "BarInternalForce", "BarStress", "LineSupportReaction", "LineConnectionResultant"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}, selected="QuantityEstimationSteel")  # disabled
getfemodel = FEMDesignGetFeModel(Connection=rundesign_2.Connection, RunNode=True)  # -> Connection, FiniteElement, Success; disabled
getresults_2 = FEMDesignGetResults(Connection=rundesign_2.Connection, ResultType=resultstype, RunNode=True)  # -> Connection, Results, Success; disabled
getquantities = FEMDesignGetQuantities(Connection=rundesign_2.Connection, QuantityType=resultstype_2, RunNode=True)  # -> Connection, Quantities, Success; disabled
fembar = FiniteElementFemBar(FiniteElement=getfemodel.FiniteElement)  # -> Identifier, ElementId, NodeI, NodeJ, LineGeometry; disabled
barsteelutilization = BarSteelUtilization(Result=getresults_2.Results)  # -> Id, SectionName, Max, RCS, FB, TFB, LTBt, LTBb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; disabled
explode = Explode(Object=getquantities.Quantities, Component="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")  # -> Id, Storey, Structure, Quality, Section, UnitWeight, SubTotal, TotalWeight, PaintedArea; disabled
ma = MassAddition(Input=explode.TotalWeight)  # -> Result, PartialResults; disabled
result_1 = Data(ma.Result)  # disabled
panel_3 = Panel("Mass: ")  # disabled
join = JoinCurves(Curves=fembar.LineGeometry, Preserve=False)  # -> flatten(Curves); disabled
panel_4 = Panel("nº of sections: ")  # disabled
int = Integer(result_1)  # disabled
num = Number(expr("round(x,2)", result_1))  # disabled
panel_5 = Panel(" kg")  # disabled
panel_6 = Panel("")  # disabled
cset_4 = CreateSet(List=barsteelutilization.SectionName)  # -> Set, Map; disabled
concat = Concatenate(FragmentA=panel_3, FragmentB=int, FragmentC=panel_5, JoinSeparator=" ")  # disabled
lng = ListLength(List=cset_4.Set)  # disabled
result_1_2 = Data(lng)  # disabled
int_2 = Integer(result_1_2)  # disabled
num_2 = Number(expr("round(x,2)", result_1_2))  # disabled
concat_2 = Concatenate(FragmentA=panel_4, FragmentB=int_2, FragmentC=panel_6, JoinSeparator=" ")  # disabled
mindex_4 = MemberIndex(Set=barsteelutilization.SectionName, Member=cset_4.Set)  # -> Index, Count; disabled
tstat_2 = TreeStatistics(Tree=mindex_4.Index)  # -> Paths, Length, Count; disabled
entwine_5 = Entwine(Branch00=concat, Branch01=concat_2, FlattenInputs=True)  # -> flatten(Result); disabled
range = Range(Domain=Domain(0, 1), Steps=expr("x-1", tstat_2.Count))  # disabled
swatch = ColourSwatch(SwatchColor=RGB(5, 5, 5))  # disabled
gradient = Gradient(
    LowerLimit=0,
    UpperLimit=1,
    Parameter=range,
    stops=[0: RGB(243, 57, 0), 0.1: RGB(236, 27, 60), 0.2: RGB(210, 0, 118), 0.3: RGB(103, 0, 120), 0.4: RGB(39, 72, 161), 0.5: RGB(1, 192, 229), 0.6: RGB(18, 178, 90), 0.7: RGB(79, 186, 8), 0.8: RGB(220, 237, 32), 0.95: RGB(247, 159, 20), 1: RGB(247, 159, 20)])  # disabled
left_right_position_pixels = Panel("50")  # disabled
spacing_pixels = Panel("30")  # disabled
up_down_position_pixels = Panel("50")  # disabled
item_7 = ListItem(List=join, Index=mindex_4.Index, Wrap=True)  # -> simplify(Item); disabled
lng_2 = ListLength(List=entwine_5)  # disabled
series = Series(Start=up_down_position_pixels, Step=spacing_pixels, Count=lng_2)  # disabled
pt_2 = ConstructPoint(XCoordinate=left_right_position_pixels, YCoordinate=series, ZCoordinate=0)  # disabled
col = Colour(gradient)  # disabled
panel_7 = Panel("3")  # disabled
graft_2 = GraftTree(Tree=col, IncludeEmptyLists=True, IncludeNullItems=True)  # disabled
texttoscreen = RenderTextToScreen(Text=entwine_5, Location=pt_2, Size=14, Color=swatch, Font="Inconsolata", m_scWithvp=False)  # disabled
previewlw = CustomPreviewLineweights(Geometry=item_7, Shader=graft_2, Thickness=panel_7, Absolute=False)  # disabled
