# Grasshopper definition optimise.gh (Grasshopper 1.0.7)
# plug-ins: FEM-Design, Alpaca4d, eleFront

crv = Curve([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])
number_slider = Slider(0.591, range=0..1)
item = ListItem(List=crv, Index=0, Wrap=True)  # -> Item, Item1

# ---- group: LoadSnippet
value_list = ValueList({"ordinary", "dead_load", "soil_dead_load", "shrinkage", "prestressing", "fire", "seis_sxp", "seis_sxm", "seis_syp", "seis_sym"}, selected="ordinary")
value_list_2 = ValueList({"permanent", "long-term", "medium-term", "short-term", "instantaneous"}, selected="permanent")
value_list_3 = ValueList({"ordinary", "dead_load", "soil_dead_load", "shrinkage", "prestressing", "fire", "seis_sxp", "seis_sxm", "seis_syp", "seis_sym"}, selected="dead_load")
value_list_4 = ValueList({"permanent", "long-term", "medium-term", "short-term", "instantaneous"}, selected="permanent")
loadcase_construct = LoadCaseConstruct(Name="LL", Type=value_list, DurationClass=value_list_2)
loadcase_construct_2 = LoadCaseConstruct(Name="DL", Type=value_list_3, DurationClass=value_list_4)
value_list_5 = ValueList({"ultimate_ordinary", "ultimate_accidental", "ultimate_seismic", "serviceability_quasi_permanent", "serviceability_frequent", "serviceability_characteristic"}, selected="ultimate_ordinary")
merge = Merge(Data1=loadcase_construct_2, Data2=loadcase_construct)
panel = Panel("""1.35
1.5""")
Z = UnitZ(Factor="-10.00")
loadcombination_construct = LoadCombinationConstruct(Name="ULS_DL", Type=value_list_5, LoadCase=merge, Gamma=panel)  # -> flatten(LoadCombination)
force = LineLoadForce(Curve=item.Item1, StartForce=Z, LoadCase=loadcase_construct, ConstLoadDir=True, LoadProjection=False)
loadcombinations = Data(loadcombination_construct)
loadcases = Data([loadcase_construct_2, loadcase_construct])

# ----
default = MaterialDatabaseDefault(CountryCode="S")  # -> SteelMaterial, ConcreteMaterial, TimberMaterial, ReinforcementMaterial, StratumMaterial, CustomMaterial
default_2 = SectionDatabaseDefault()  # -> SteelSection, ConcreteSection, TimberSection, HollowCoreSection, CustomSection
panel_2 = Panel("""0.00
1.00""")
join = JoinCurves(Curves=crv, Preserve=False)
item_2 = ListItem(List=default.SteelMaterial, Index=0, Wrap=True)
item_3 = ListItem(List=default_2.SteelSection, Index="10", Wrap=True)
hframe = HorizontalFrame(Curve=reparameterize(join), Parameter=panel_2)
hframe_2 = HorizontalFrame(Curve=reparameterize(join), Parameter=number_slider)
rigid = PointSupportRigid(PointPlane=hframe, Identifier="S")
hinged = PointSupportHinged(PointPlane=hframe_2, Identifier="S")
beam = BarsBeam(Curve=crv, Material=item_2, Section=item_3, OrientLCS=True, Identifier="B")
construct = ModelConstruct(
    CountryCode="S",
    StructureElements=flatten([beam, hinged, rigid]),
    Loads=force,
    LoadCases=loadcases,
    LoadCombinations=loadcombinations)
resultstype = ResultsType({"NodalDisplacement", "NodalDisplacement", "PointSupportReaction", "PointSupportReactionMinMax", "PointConnectionForce", "BarDisplacement", "BarInternalForce", "BarStress", "LineSupportReaction", "LineConnectionResultant"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}, selected="NodalDisplacement")
resultstype_2 = ResultsType({"NodalDisplacement", "NodalDisplacement", "PointSupportReaction", "PointSupportReactionMinMax", "PointConnectionForce", "BarDisplacement", "BarInternalForce", "BarStress", "LineSupportReaction", "LineConnectionResultant"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}, selected="PointSupportReaction")
analysis = AnalysisDefine(
    CalcCase=True,
    CalcCstage=False,
    CalcImpf=False,
    CalcComb=True,
    CalcGmax=False,
    CalcStab=False,
    CalcFreq=False,
    CalcSeis=False,
    CalcDesign=False,
    CalcFootfall=False,
    Elemfine=False,
    Diaphragm=False,
    PeakSmoothing=False)
merge_2 = Merge(Data1=resultstype, Data2=resultstype_2)
units = Units(Length="m", Angle="rad", SectionalData="m", Force="kN", Mass="kg", Displacement="mm", Stress="Pa")
run = ApplicationRun(Model=construct, Analysis=analysis, ResultTypes=merge_2, Units=units, RunNode=Toggle(True))  # -> Model, FiniteElement, Results
bang = ExplodeTree(Data=run.Results)  # -> Branch0, Branch1
deconstruct = ModelDeconstruct(Model=construct)  # -> CountryCode, Foundations, Bars, FictitiousBars, Shells, FictitiousShells, Diaphragms, LabelledSection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
nodaldisplacement = NodalDisplacement(Result=bang.Branch0, CaseCombinationName="ULS_DL")  # -> CaseIdentifier, NodeId, Translation, Rotation
femnode = FiniteElementFemNode(FiniteElement=run.FiniteElement)  # -> NodeId, Point
pointsupportreaction = PointSupportReaction(Result=bang.Branch1, CaseCombinationName="ULS_DL")  # -> CaseIdentifier, Identifier, NodeId, SupportPosition, ReactionForce, ReactionMoment, ForceResultant, MomentResultant
deconstruct_modify = BarDeconstructModify(Bar=deconstruct.Bars)  # -> Bar, Guid, Curve, Material, Section, Connectivity, Eccentricity, LocalY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
devec = DeconstructVector(Vector=pointsupportreaction.ReactionForce)  # -> XComponent, YComponent, ZComponent
keysearch = KeyValueSearch(Keys=femnode.NodeId, Values=femnode.Point, Search=nodaldisplacement.NodeId)
Z_2 = UnitZ(Factor="0.5")
item_4 = ListItem(List=deconstruct_modify.Section, Index=0, Wrap=True)
vlen = VectorLength(Vector=nodaldisplacement.Translation)
panel_3 = Panel("""0.0
1.0""")
clr = ColorsAlpaca4d(GradientIndex=Slider(4, range=0..12))  # -> reverse(Colors)
move = Move(Geometry=pointsupportreaction.SupportPosition, Motion=Z_2)  # -> Geometry, Transform
sort = SortList(Keys=vlen, ValuesA=keysearch)  # -> Keys, ValuesA
graft = GraftTree(Tree=deconstruct_modify.Curve, IncludeEmptyLists=True, IncludeNullItems=True)
bnd = Bounds(Numbers=vlen)
deconstruct_2 = SectionDeconstruct(Section=item_4)  # -> Guid, Name, Surfaces, SectionType, MaterialType, GroupName, TypeName, SizeName
textdot = DefineTextDot(Text=devec.ZComponent, Location=move.Geometry, Font="Arial", Size=14)
pframe = PerpFrame(Curve=reparameterize(graft), Parameter=panel_3)
lng = ListLength(List=clr)
item_5 = ListItem(List=reverse(sort.Keys), Index=0, Wrap=True)
item_6 = ListItem(List=reverse(sort.ValuesA), Index=0, Wrap=True)
vec = VectorXYZ(XComponent="1", YComponent="1", ZComponent="1")  # -> Vector, Length
div = DivideDomain(Domain=bnd, Count=lng)
int = Integer(item_5)
orient = Orient(Geometry=deconstruct_2.Surfaces, Source=PlaneXY(0, 0, 0), Target=pframe)  # -> Geometry, Transform
concat = Concatenate(FragmentA="max disp = ", FragmentB=int, FragmentC=" mm")
inc = Includes(Domain=Domain(0, 1))  # -> Includes, Deviation
fdom = FindDomain(Domains=div, Number=vlen, Strict=False)  # -> Index, Neighbour
line = LineSDL(Start=item_6, Direction=vec.Vector, Length="2")
remap = RemapNumbers(Value=vlen, Source=bnd, Target="0.10 to 0.50")  # -> Mapped, Clipped
swp1 = Sweep1(Rail=graft, Sections=orient.Geometry, Miter=1)
item_7 = ListItem(List=clr, Index=fdom.Index, Wrap=True)
markdim = MarkerDimension(Line=line, Text=concat, Size="0.5")
dots = DotDisplay(Point=keysearch, Colour=item_7, Size=remap.Mapped)
galapagos = Galapagos(fitness=num, gene=number_slider)
num = Number(item_5)
