# Grasshopper definition reinforcement.gh (Grasshopper 1.0.7)
# plug-ins: FEM-Design

default = MaterialDatabaseDefault(CountryCode="S")  # -> SteelMaterial, ConcreteMaterial, TimberMaterial, ReinforcementMaterial, StratumMaterial, CustomMaterial
m_to_mmm = Number(expr("x/1000", "600"))
m_to_mmm_2 = Number(expr("x/1000", "300"))
division = Division(A=m_to_mmm, B=2)
division_2 = Division(A=m_to_mmm_2, B=2)
m_to_mmm_3 = Number(expr("x/1000", "8"))
neg = Negative(Value=division)
neg_2 = Negative(Value=division_2)
item = ListItem(List=default.ReinforcementMaterial, Index=0, Wrap=True)
m_to_mmm_4 = Number(expr("x/1000", "16"))
m_to_mmm_5 = Number(expr("x/1000", "0"))
m_to_mmm_6 = Number(expr("x/1000", "20"))
dom = ConstructDomain(DomainStart=neg, DomainEnd=division)
pt = Point(Point(0, 0, 0))
X = UnitX(Factor=1)
dom_2 = ConstructDomain(DomainStart=neg_2, DomainEnd=division_2)
define = WireDefine(Diameter=m_to_mmm_3, Material=item, Profile="ribbed")
default_2 = MaterialDatabaseDefault(CountryCode="S")  # -> SteelMaterial, ConcreteMaterial, TimberMaterial, ReinforcementMaterial, StratumMaterial, CustomMaterial
rectangle = Rectangle(Plane=PlaneXY(0, 0, 0), XSize=dom_2, YSize=dom, Radius=0)  # -> Rectangle, Length
define_2 = SectionDefine(Surfaces=rectangle.Rectangle, MaterialType="Concrete", GroupName="mysizse", TypeName="mysizse", SizeName="mysizse")
neg_3 = Negative(Value="0.02")
panel = Panel("""0,0.15,150
0.85,1,150
0.15,0.85,300""")
line = LineSDL(Start=pt, Direction=X, Length="10")
offset = OffsetCurve(Curve=rectangle.Rectangle, Distance=neg_3, Corners=1)
crv = Curve(offset)
explode = Explode(Curve=crv, Recursive=True)  # -> Segments, Vertices
item_2 = ListItem(List=default_2.ConcreteMaterial, Index=0, Wrap=True)
split = TextSplit(Text=panel, Separators=",")
beam = BarsBeam(Curve=line, Material=item_2, Section=define_2, OrientLCS=True, Identifier="B")
define_3 = WireDefine(Diameter=m_to_mmm_4, Material=item, Profile="ribbed")
len = Length(Curve=line)
item_3 = ListItem(List=split, Index=0, Wrap=True)  # -> Item, Item1, Item2
item_4 = ListItem(List=explode.Segments, Index="2", Wrap=True)
item_5 = ListItem(List=explode.Segments, Index=0, Wrap=True)
Y = UnitY(Factor=m_to_mmm_6)
rev = Reverse(Vector=Y)
m_to_mmm_7 = Number(expr("x/1000", item_3.Item2))
move = Move(Geometry=item_5, Motion=Y)  # -> Geometry, Transform
multiplication = Multiplication(A=len, B=item_3.Item)
multiplication_2 = Multiplication(A=len, B=item_3.Item1)
move_2 = Move(Geometry=item_4, Motion=rev)  # -> Geometry, Transform
panel_2 = Panel("""0
-1""")
divide = DivideCurve(Curve=move.Geometry, Count="5", Kinks=False)  # -> Points, Tangents, Parameters
divide_2 = DivideCurve(Curve=move_2.Geometry, Count="3", Kinks=False)  # -> Points, Tangents, Parameters
stirrups = BarReinforcementStirrups(Wire=define, Profile=offset, Start=multiplication, End=multiplication_2, Spacing=m_to_mmm_7)  # -> flatten(Stirrups)
panel_3 = Panel("""0
-1""")
cull_i = CullIndex(List=divide_2.Points, Indices=panel_2, Wrap=True)
cull_i_2 = CullIndex(List=divide.Points, Indices=panel_3, Wrap=True)
pdecon = Deconstruct(Point=cull_i)  # -> XComponent, YComponent, ZComponent
pdecon_2 = Deconstruct(Point=cull_i_2)  # -> XComponent, YComponent, ZComponent
longitudinalbar = BarReinforcementLongitudinalBar(
    Wire=define_3,
    YPos=pdecon.XComponent,
    ZPos=pdecon.YComponent,
    StartAnchorage=m_to_mmm_5,
    EndAnchorage=m_to_mmm_5,
    Start="5",
    End="10",
    AuxiliaryBar=False)
longitudinalbar_2 = BarReinforcementLongitudinalBar(
    Wire=define_3,
    YPos=pdecon_2.XComponent,
    ZPos=pdecon_2.YComponent,
    StartAnchorage=m_to_mmm_5,
    EndAnchorage=m_to_mmm_5,
    Start="0",
    End="5",
    AuxiliaryBar=False)
connection = FEMDesignConnection(DeleteOutputFolder=False)
merge = Merge(Data1=longitudinalbar_2, Data2=longitudinalbar)
deconstruct_modify = BarDeconstructModify(Bar=beam, Stirrups=stirrups, LongitudinalBars=merge)  # -> Bar, Guid, Curve, Material, Section, Connectivity, Eccentricity, LocalY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
construct = ModelConstruct(CountryCode="S", StructureElements=deconstruct_modify.Bar)
openmodel = FEMDesignOpenModel(Connection=connection, Model=construct, RunNode=True)  # -> Connection, Model, Success; disabled
