# Grasshopper definition eigen_buckling.gh (Grasshopper 1.0.7)
# plug-ins: BullAnt, FEM-Design, Kangaroo2 Components, Human, BH.UI.Grasshopper

end_a = Point(<point referenced from the Rhino model>)
end_b = Point(<point referenced from the Rhino model>)
dir_1 = Point(<point referenced from the Rhino model>)
pin = Point(<point referenced from the Rhino model>)
dir_2 = Point(<point referenced from the Rhino model>)
vec2pt = Vector2Pt(PointA=end_a, PointB=dir_1, Unitize=False)  # -> Vector, Length
vec2pt_2 = Vector2Pt(PointA=end_a, PointB=dir_2, Unitize=False)  # -> Vector, Length
vec2pt_3 = Vector2Pt(PointA=pin, PointB=end_b, Unitize=False)  # -> Vector, Length
vec2pt_4 = Vector2Pt(PointA=end_a, PointB=pin, Unitize=False)  # -> Vector, Length
arc = ArcSED(Start=end_a, End=pin, Direction=expr("x", vec2pt_2.Vector))  # -> Arc, Plane, Radius
arc_2 = ArcSED(Start=end_a, End=pin, Direction=expr("x", vec2pt.Vector))  # -> Arc, Plane, Radius
end = EndPoints(Curve=arc_2.Arc)  # -> Start, End
eval = EvaluateCurve(Curve=arc_2.Arc, Parameter=end.End)  # -> Point, Tangent, Length
eval_2 = EvaluateCurve(Curve=reparameterize(arc.Arc), Parameter="1.00")  # -> Point, Tangent, Angle
arc_3 = ArcSED(Start=pin, End=end_b, Direction=expr("x", eval_2.Tangent))  # -> Arc, Plane, Radius
arc_4 = ArcSED(Start=pin, End=end_b, Direction=expr("x", eval.Tangent))  # -> Arc, Plane, Radius
rot3d = Rotate3D(Geometry=arc_2.Arc, Angle=Slider(0.5549, range=0..0.7854), Center=end_a, Axis=vec2pt_4.Vector)  # -> Geometry, Transform
rot3d_2 = Rotate3D(Geometry=arc_3.Arc, Angle=Slider(0.26, range=0..0.7854), Center=end_b, Axis=vec2pt_3.Vector)  # -> Geometry, Transform
mirror = Mirror(Geometry=rot3d.Geometry, Plane=PlaneYZ(0, 0, 0))  # -> Geometry, Transform
mirror_2 = Mirror(Geometry=rot3d_2.Geometry, Plane=PlaneYZ(0, 0, 0))  # -> Geometry, Transform
slider = Slider(16, range=5..20)
slider_2 = Slider(10, range=5..20)
crv = Curve(arc.Arc)
crv_2 = Curve([mirror.Geometry, rot3d.Geometry])
crv_3 = Curve([mirror_2.Geometry, rot3d_2.Geometry])
crv_4 = Curve(arc_4.Arc)
sdrcc = SdrConnectCurves(FirstCurve=rot3d_2.Geometry, SecondCurve=mirror_2.Geometry, NumberDivision=slider, TrussType=0)  # -> ChordACurves, ChordBCurves, Diagonals, Verticals
sdrcc_2 = SdrConnectCurves(FirstCurve=crv_3, SecondCurve=crv_4, NumberDivision=slider, TrussType=0)  # -> ChordACurves, ChordBCurves, Diagonals, Verticals
sdrcc_3 = SdrConnectCurves(FirstCurve=crv_2, SecondCurve=crv, NumberDivision=slider_2, TrussType=0)  # -> ChordACurves, ChordBCurves, Diagonals, Verticals
sdrcc_4 = SdrConnectCurves(FirstCurve=mirror.Geometry, SecondCurve=rot3d.Geometry, NumberDivision=slider_2, TrussType=0)  # -> ChordACurves, ChordBCurves, Diagonals, Verticals
default = MaterialDatabaseDefault(CountryCode="S")  # -> SteelMaterial, ConcreteMaterial, TimberMaterial, ReinforcementMaterial, StratumMaterial, CustomMaterial
branch = TreeBranch(Tree=sdrcc_2.ChordBCurves, Path="{0;0}", MaintainPaths=False)
branch_2 = TreeBranch(Tree=sdrcc_3.ChordBCurves, Path="{0;0}", MaintainPaths=False)
default_2 = SectionDatabaseDefault()  # -> SteelSection, ConcreteSection, TimberSection, HollowCoreSection, CustomSection
simple = PointSupportSimple(PointPlane=end_a, Tx=True, Ty=True, Tz=True, Rx=True, Ry=True, Rz=True, Identifier="S")
simple_2 = PointSupportSimple(PointPlane=end_b, Tx=True, Ty=True, Tz=True, Rx=True, Ry=True, Rz=True, Identifier="S")
item = ListItem(List=default_2.SteelSection, Index="600", Wrap=True)
item_2 = ListItem(List=default.SteelMaterial, Index="3", Wrap=True)
crv_5 = Curve([sdrcc_2.ChordACurves, branch_2])
crv_6 = Curve([sdrcc_3.ChordACurves, branch])
crv_7 = Curve([sdrcc.Verticals, sdrcc_4.Verticals])
crv_8 = Curve([sdrcc_2.Diagonals, sdrcc_3.Diagonals])
crv_9 = Curve([sdrcc_2.Verticals, sdrcc_3.Verticals])
entwine = Entwine(Branch00=crv_5, Branch01=crv_6, Branch02=crv_7, Branch03=crv_8, Branch04=crv_9, FlattenInputs=True)
end_2 = EndPoints(Curve=entwine)  # -> Start, End
duppt = RemoveDuplicatePts(Points=flatten([end_2.Start, end_2.End]), Tolerance=0.01)

# ---- group: LoadSnippet
value_list = ValueList({"ordinary", "dead_load", "soil_dead_load", "shrinkage", "prestressing", "fire", "seis_sxp", "seis_sxm", "seis_syp", "seis_sym"}, selected="ordinary")
value_list_2 = ValueList({"permanent", "long-term", "medium-term", "short-term", "instantaneous"}, selected="permanent")
value_list_3 = ValueList({"ordinary", "dead_load", "soil_dead_load", "shrinkage", "prestressing", "fire", "seis_sxp", "seis_sxm", "seis_syp", "seis_sym"}, selected="dead_load")
value_list_4 = ValueList({"permanent", "long-term", "medium-term", "short-term", "instantaneous"}, selected="permanent")
unit_z = UnitZ(Factor="-50")
pt = Point(duppt)
loadcase_construct = LoadCaseConstruct(Name="LL", Type=value_list, DurationClass=value_list_2)
loadcase_construct_2 = LoadCaseConstruct(Name="DL", Type=value_list_3, DurationClass=value_list_4)
value_list_5 = ValueList({"ultimate_ordinary", "ultimate_accidental", "ultimate_seismic", "serviceability_quasi_permanent", "serviceability_frequent", "serviceability_characteristic"}, selected="ultimate_ordinary")
merge = Merge(Data1=loadcase_construct_2, Data2=loadcase_construct)
panel = Panel("""1.35
1.5""")
pointload_force = PointLoadForce(Point=pt, Force=unit_z, LoadCase=loadcase_construct)
loadcombination_construct = LoadCombinationConstruct(Name="ULS_DL", Type=value_list_5, LoadCase=merge, Gamma=panel)  # -> flatten(LoadCombination)
loadcombinations = Data(loadcombination_construct)
loadcases = Data([loadcase_construct_2, loadcase_construct])
loads = Data(pointload_force)

# ----
beam = BarsBeam(Curve=entwine, Material=item_2, Section=item, OrientLCS=True, Identifier="B")
construct = ModelConstruct(
    CountryCode="S",
    StructureElements=flatten([simple, simple_2, beam]),
    Loads=loads,
    LoadCases=loadcases,
    LoadCombinations=loadcombinations)
connection = FEMDesignConnection(DeleteOutputFolder=False)
model = Data(construct)
openmodel = FEMDesignOpenModel(Connection=connection, Model=model, RunNode=True)  # -> Connection, Model, Success
stability = StabilityDefine(LoadCombination=loadcombinations, NumShapes="5", PositiveOnly=False, NumIterations=20)
toggle = BooleanToggle(False)
analysis = AnalysisDefine(
    Stability=stability,
    CalcCase=toggle,
    CalcCstage=False,
    CalcImpf=False,
    CalcComb=toggle,
    CalcGmax=False,
    CalcStab=Toggle(True),
    CalcFreq=False,
    CalcSeis=False,
    CalcDesign=False,
    CalcFootfall=False,
    Elemfine=False,
    Diaphragm=False,
    PeakSmoothing=False)
runanalysis = FEMDesignRunAnalysis(Connection=openmodel.Connection, Analysis=analysis, RunNode=True)  # -> Connection, Log, Success
stabilityresults = FEMDesignGetStabilityResults(Connection=runanalysis.Connection, RunNode=True)  # -> Connection, BucklingShapes, CriticalParameter, Success
number_slider = Slider(1, range=1..5)
getfemodel = FEMDesignGetFeModel(Connection=stabilityresults.Connection, RunNode=True)  # -> Connection, FiniteElement, Success
fembar = FiniteElementFemBar(FiniteElement=getfemodel.FiniteElement)  # -> Identifier, ElementId, NodeI, NodeJ, LineGeometry
explode = Explode(Object=stabilityresults.CriticalParameter, Component="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")  # -> CaseIdentifier, Shape, CriticalParam
nodalbucklingshape = NodalBucklingShape(Result=stabilityresults.BucklingShapes, BucklingShape=number_slider)  # -> Identifier, CaseIdentifier, ShapeId, NodeId, Translation, Rotation
femnode = FiniteElementFemNode(FiniteElement=getfemodel.FiniteElement)  # -> NodeId, Point
int = Integer(number_slider)
keysearch = KeyValueSearch(Keys=explode.Shape, Values=explode.CriticalParam, Search=int)
number_slider_2 = Slider(59.88, range=0..100)
keysearch_2 = KeyValueSearch(Keys=femnode.NodeId, Values=femnode.Point, Search=fembar.NodeI)
keysearch_3 = KeyValueSearch(Keys=femnode.NodeId, Values=femnode.Point, Search=fembar.NodeJ)
keysearch_4 = KeyValueSearch(Keys=nodalbucklingshape.NodeId, Values=nodalbucklingshape.Translation, Search=fembar.NodeI)
keysearch_5 = KeyValueSearch(Keys=nodalbucklingshape.NodeId, Values=nodalbucklingshape.Translation, Search=fembar.NodeJ)
multiplication = Multiplication(A=keysearch_4, B=number_slider_2)
multiplication_2 = Multiplication(A=keysearch_5, B=number_slider_2)
move = Move(Geometry=keysearch_2, Motion=multiplication)  # -> Geometry, Transform
move_2 = Move(Geometry=keysearch_3, Motion=multiplication_2)  # -> Geometry, Transform
ln = Line(StartPoint=move.Geometry, EndPoint=move_2.Geometry)

# ---- group: visualisation: Data on screen
result_1 = Data(keysearch)
num = Number(expr("round(x,2)", result_1))
concat = Concatenate(FragmentA="Buckling factor: ", FragmentB=num, JoinSeparator=" ")
entwine_2 = Entwine(Branch00=concat, FlattenInputs=True)  # -> flatten(Result)
entwine_3 = Entwine(Branch00=ColourSwatch(SwatchColor=RGB(0, 0, 0)), FlattenInputs=True)  # -> flatten(Result)
left_right_position_pixels = Panel("50")
spacing_pixels = Panel("30")
up_down_position_pixels = Panel("50")
lng = ListLength(List=entwine_2)
series = Series(Start=up_down_position_pixels, Step=spacing_pixels, Count=lng)
pt_2 = ConstructPoint(XCoordinate=left_right_position_pixels, YCoordinate=series, ZCoordinate=0)
texttoscreen = RenderTextToScreen(Text=entwine_2, Location=pt_2, Size=14, Color=entwine_3, Font="Inconsolata", m_scWithvp=False)

# ----
fembar_2 = FiniteElementFemBar(FiniteElement=getfemodel.FiniteElement)  # -> Identifier, ElementId, NodeI, NodeJ, LineGeometry
dash = DashPattern(Curve=fembar_2.LineGeometry, Pattern="0.20")  # -> Dashes, Gaps
previewlw = CustomPreviewLineweights(Geometry=ln, Shader=ColourSwatch(SwatchColor=RGB(1, 72, 130)), Thickness="1", Absolute=False)
previewlw_2 = CustomPreviewLineweights(Geometry=dash.Dashes, Shader=ColourSwatch(SwatchColor=RGB(107, 107, 107)), Thickness="1", Absolute=False)
