# Grasshopper definition roller-coaster.gh (Grasshopper 1.0.7)
# plug-ins: FEM-Design, Kangaroo2 Components, Weaverbird

crv = Curve(<curve referenced from the Rhino model>)
divide = DivideCurve(Curve=crv, Count="400", Kinks=False)  # -> Points, Tangents, Parameters
pframe = PerpFrame(Curve=crv, Parameter=divide.Parameters)
offset_l = OffsetCurveLoose(Curve=crv, Distance=1)
merge = Merge(Data1=crv, Data2=offset_l)
loft = Loft(Curves=merge, Options={Adjust=False, Closed=False, LoftEnds=0, LoftSimp=0, LoftType=0, Rebuild=10, Refit=0.01})
divide_2 = DivideDomain²(Domain=loft, UCount="1", VCount="400")
subsrf = Isotrim(Surface=loft, Domain=divide_2)
debrep = DeconstructBrep(Brep=subsrf)  # -> Faces, Edges, Vertices
smesh = SimpleMesh(Brep=debrep.Faces)
item = ListItem(List=debrep.Edges, Index=0, Wrap=True)
tri = Triangulate(Mesh=smesh)  # -> Mesh, Count
dupln = RemoveDuplicateLines(Lines=flatten(item), Tolerance=0.01)
wbfacepolys = WeaverbirdsFacePolylines(Mesh=tri.Mesh)  # -> graft(Polygons)
midpt = CurveMiddle(Curve=dupln)
default = MaterialDatabaseDefault(CountryCode="S")  # -> SteelMaterial, ConcreteMaterial, TimberMaterial, ReinforcementMaterial, StratumMaterial, CustomMaterial
boundary = BoundarySurfaces(Edges=wbfacepolys)
pline = PolyLine(Vertices=midpt, Closed=False)
vehicledatabase_default_or_fromstruxml = VehicleDatabase()
item_2 = ListItem(List=default.ConcreteMaterial, Index=0, Wrap=True)
lng = ListLength(List=midpt)
item_3 = ListItem(List=vehicledatabase_default_or_fromstruxml, Index=0, Wrap=True)
rectangle = Rectangle(Plane=PlaneXY(0, 0, 0), XSize=Domain(-1, 1), YSize=Domain(-2, 2), Radius=0)  # -> Rectangle, Length
movingload_construct = MovingLoadConstruct(Name="RollerCoast", Vehicle=item_3, Curve=pline, DivisionNumber=lng, Return=False, LockDirection=True, CutPath=False)
construct = Plate(Surface=boundary, Thickness="0.25", Material=item_2, Identifier="P")
construct_2 = ModelConstruct(CountryCode="S", StructureElements=flatten(construct), Loads=movingload_construct)
connection = FEMDesignConnection(DeleteOutputFolder=False)
movingload_construct_2 = MovingLoadConstruct(
    Name="RollerCoast",
    Vehicle=null,
    Curve=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,
    DivisionNumber=400,
    Return=False,
    LockDirection=True,
    CutPath=False)
vehicledatabase_default_or_fromstruxml_2 = VehicleDatabase()
openmodel = FEMDesignOpenModel(Connection=connection, Model=construct_2, RunNode=True)  # -> Connection, Model, Success
