# Grasshopper definition WindOnCircle_v2.gh (Grasshopper 1.0.7)
# plug-ins: Kangaroo2 Components, Human, FEM-Design

cir = Circle(Plane=PlaneXY(0, 0, 0), Radius=1)
crvdom = CurveDomain(Curve=cir, Domain="0 to 360")  # -> Curve, Domain
seam = Seam(Curve=crvdom.Curve, Seam="180")
Z = UnitZ(Factor="10")
extr = Extrude(Base=cir, Direction=Z)
end_factor = Panel("0.6 - 1.0")
# Re lXmin CpO,min aA CpO,h
panel = Panel("5'10b 85 -2,2 135 -0,4")
int = Integer("135")
num = Number("0.8")
range = Range(Domain="180", Steps="45")
int_2 = Integer("85")
crv = Curve(<curve referenced from the Rhino model>)
crv_2 = Curve(<curve referenced from the Rhino model>)
crv_3 = Curve(<curve referenced from the Rhino model>)
python = GhPythonScript(alpha_min=int_2, alpha_a=int, end_factor=num, alpha=range)  # -> out, psi; inputs alpha_min: Int32
# ---------- python: Python ----------
__author__ = "Marco"
__version__ = "2023.07.18"

import rhinoscriptsyntax as rs
import math


if 0 <= alpha <= alpha_min or 0 <= alpha <= -alpha_min:
    psi = 1
elif alpha_min < alpha < alpha_a or -alpha_min < alpha < -alpha_a:
    psi = end_factor + (1 - end_factor) * math.cos(  ( math.pi/2 * ( (alpha - alpha_min)/(alpha_a - alpha_min) ) ) )
elif alpha_a <= alpha <= 180 or -alpha_a <= alpha <= -180:
    psi = end_factor
# ---------- end python ----------
default = MaterialDatabaseDefault(CountryCode="S")  # -> SteelMaterial, ConcreteMaterial, TimberMaterial, ReinforcementMaterial, StratumMaterial, CustomMaterial
crvdom_2 = CurveDomain(Curve=crv, Domain="0 to 180")  # -> Curve, Domain
crvdom_3 = CurveDomain(Curve=crv_3, Domain="-2.00 to 1.00")  # -> Curve, Domain
panel_2 = Panel("-2,2 ")
panel_3 = Panel("-0,4")
divide = DivideDomain²(Domain=extr, UCount=Slider(11, range=2..20), VCount=Slider(20, range=2..20))
eval = EvaluateCurve(Curve=crvdom_2.Curve, Parameter=range)  # -> Point, Tangent, Angle
subsrf = Isotrim(Surface=extr, Domain=divide)
item = ListItem(List=default.SteelMaterial, Index=0, Wrap=True)
Y = UnitY(Factor=1)
debrep = DeconstructBrep(Brep=subsrf)  # -> Faces, Edges, Vertices
project = ProjectPoint(Point=eval.Point, Direction=Y, Geometry=crv_2)  # -> Point, Index
pline = PolyLine(Vertices=debrep.Vertices, Closed=invert(False))
boundary = BoundarySurfaces(Edges=pline)
crv_cp = CurveClosestPoint(Point=project.Point, Curve=crvdom_3.Curve)  # -> Point, Parameter, Distance
cpo = Number(crv_cp.Parameter)
construct = Plate(Surface=boundary, Thickness="0.25", Material=item, Identifier="P")  # -> flatten(Slab)
multiplication = Multiplication(A=cpo, B=python.psi)
num_2 = Number(multiplication)
bnd = Bounds(Numbers=num_2)
dedomain = DeconstructDomain(Domain=bnd)  # -> Start, End
abs = Absolute(Value=[dedomain.Start, dedomain.End])
eval_2 = EvaluateCurve(Curve=seam, Parameter=range)  # -> Point, Tangent, Angle
Z_2 = UnitZ(Factor=1)
sort = SortList(Keys=abs)  # -> Keys, ValuesA
item_2 = ListItem(List=reverse(sort.Keys), Index=0, Wrap=True)
xprod = CrossProduct(VectorA=eval_2.Tangent, VectorB=Z_2, Unitize=False)  # -> Vector, Length
rev = Reverse(Vector=xprod.Vector)
number_slider = Slider(1.031, range=0..10)
division = Division(A=dedomain.End, B=item_2)
division_2 = Division(A=dedomain.Start, B=item_2)
multiplication_2 = Multiplication(A=division_2, B=number_slider)
multiplication_3 = Multiplication(A=division, B=number_slider)
merge = Merge(Data1=multiplication_2, Data2=multiplication_3)
bnd_2 = Bounds(Numbers=merge)
remap = RemapNumbers(Value=num_2, Source=bnd, Target=bnd_2)  # -> Mapped, Clipped
line = LineSDL(Start=eval_2.Point, Direction=rev, Length=remap.Mapped)
xz = XZPlane(Origin=Point(0, 0, 0))
dedomain_2 = DeconstructDomain(Domain=bnd_2)  # -> Start, End
mirror = Mirror(Geometry=line, Plane=xz)  # -> Geometry, Transform
rev_2 = ReverseList(List=mirror.Geometry)
gradient = Gradient(
    LowerLimit=dedomain_2.Start,
    UpperLimit=dedomain_2.End,
    Parameter=remap.Mapped,
    stops=[0: RGB(234, 38, 0), 0.22: RGB(234, 126, 0), 0.501: RGB(254, 244, 84), 0.783: RGB(173, 203, 249), 1: RGB(75, 107, 169)])
merge_2 = Merge(Data1=line, Data2=rev_2)
midpt = CurveMiddle(Curve=merge_2)
dupln = RemoveDuplicateLines(Lines=merge_2, Tolerance=0.01)
cullpt = CullDuplicates(Points=midpt, Tolerance="0.001", CullMode=3)  # -> Points, Indices, Valence
rev_3 = ReverseList(List=gradient)
merge_3 = Merge(Data1=gradient, Data2=rev_3)
item_3 = ListItem(List=merge_3, Index=cullpt.Indices, Wrap=True)
previewlw = CustomPreviewLineweights(Geometry=cir, Shader=ColourSwatch(SwatchColor=RGB(0, 0, 0)), Thickness="5", Absolute=False)
previewlw_2 = CustomPreviewLineweights(Geometry=dupln, Shader=item_3, Thickness="2", Absolute=False)
series = Series(Start=0, Step=1, Count=10)
graft = GraftTree(Tree=dupln, IncludeEmptyLists=True, IncludeNullItems=True)
Z_3 = UnitZ(Factor=series)
move = Move(Geometry=graft, Motion=Z_3)  # -> Geometry, Transform
list = ValueList({"ordinary", "dead_load", "soil_dead_load", "shrinkage", "prestressing", "fire", "seis_sxp", "seis_sxm", "seis_syp", "seis_sym"}, selected="ordinary")
construct_2 = LoadCaseConstruct(Name="WIND", Type=list, DurationClass="permanent")
end = EndPoints(Curve=move.Geometry)  # -> Start, End
vec = Vector(move.Geometry)
construct_3 = PressureLoadConstruct()
pointload_define = PointLoadDefine(Point=end.Start, Force=vec, LoadCase=construct_2, Type="Force")
construct_4 = ModelConstruct(CountryCode="S", StructureElements=construct, Loads=flatten(pointload_define), LoadCases=construct_2)
connection = FEMDesignConnection(DeleteOutputFolder=False)
openmodel = FEMDesignOpenModel(Connection=connection, Model=construct_4, RunNode=True)  # -> Connection, Model, Success
