# Grasshopper definition Gyroid.gh (Grasshopper 1.0.7)
# Copyright: ©2019 GNU General Public License
# plug-ins: Weaverbird, FEM-Design

ct = CrystallonV2CellType(unit_cell_selector=Slider(19, range=0..29))
wbcatmullclark = WeaverbirdsCatmullClarkSubdivision(MeshCurves=ct, Level=Slider(2, range=1..3), SmoothNakedEdges=1)
demesh = DeconstructMesh(Mesh=wbcatmullclark)  # -> Vertices, Faces, Colours, Normals
pdecon = Deconstruct(Point=demesh.Vertices)  # -> XComponent, YComponent, ZComponent
materialdatabase = MaterialDatabase(CountryCode="S")  # -> SteelMaterial, ConcreteMaterial, TimberMaterial, ReinforcementMaterial, StratumMaterial, CustomMaterial
tri = Triangulate(Mesh=wbcatmullclark)  # -> Mesh, Count
smaller = SmallerThan(FirstNumber=pdecon.ZComponent, SecondNumber="0.05")  # -> SmallerThan, OrEqualTo
wbfacepolys = WeaverbirdsFacePolylines(Mesh=tri.Mesh)
item = ListItem(List=materialdatabase.ConcreteMaterial, Index=0, Wrap=True)
construct = LoadCaseConstruct(Name="Point", Type="Ordinary", DurationClass="permanent")
dispatch = Dispatch(List=demesh.Vertices, DispatchPattern=smaller.SmallerThan)  # -> ListA, ListB
X = UnitX(Factor=1)
construct_2 = Plate(Surface=wbfacepolys, Thickness="0.2", Material=item, Identifier="P")
hinged = PointSupportHinged(PointPlane=dispatch.ListA, Identifier="S")
pointload_define = PointLoadDefine(Point=dispatch.ListB, Force=X, LoadCase=construct, Type="Force")
connection = FEMDesignConnection(DeleteOutputFolder=False)
construct_3 = ModelConstruct(CountryCode="S", StructureElements=[construct_2, hinged], Loads=pointload_define, LoadCases=construct)
openmodel = FEMDesignOpenModel(Connection=connection, Model=construct_3, RunNode=True)  # -> Connection, Model, Success

# ==== cluster CrystallonV2CellType: A collection of pre-made unit cells

crv = Curve([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])
crv_2 = Curve([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])
crv_3 = Curve([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])
crv_4 = Curve([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])
crv_5 = Curve([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])
mesh = Mesh(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)
mesh_2 = Mesh(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)
mesh_3 = Mesh(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)
mesh_4 = Mesh([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])
crv_6 = Curve([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])
crv_7 = Curve([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])
crv_8 = Curve([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])
crv_9 = Curve([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])
crv_10 = Curve([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])
crv_11 = Curve([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])
crv_12 = Curve([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])
crv_13 = Curve([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])
crv_14 = Curve([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])
crv_15 = Curve([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])
crv_16 = Curve([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])
mesh_5 = Mesh(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)
mesh_6 = Mesh(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)
mesh_7 = Mesh(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)
mesh_8 = Mesh(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)
crv_17 = Curve([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])
crv_18 = Curve([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])
mesh_9 = Mesh(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)
geo = Geometry([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])
geo_2 = Geometry([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])
mesh_10 = Mesh([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])
# CRYSTALLON V2.0 -- Lattice structure tools for Grasshopper3D
# 
# Copyright (C) 2019  Aaron Porterfield
# 
# www.fequalsf.com
# info@fequalsf.com
# 
#     This program is free software: you can redistribute it and/or modify
#     it under the terms of the GNU General Public License as published by
#     the Free Software Foundation, either version 3 of the License, or any later version.
# 
#     This program is distributed in the hope that it will be useful,
#     but WITHOUT ANY WARRANTY; without even the implied warranty of
#     MERCHANTABILITY or FITNESS FOR A PARTICULAR PURPOSE.  See the
#     GNU General Public License for more details.
# 
#     You should have received a copy of the GNU General Public License
#     along with this program.  If not, see <http://www.gnu.org/licenses/>.
panel = Panel("CELL TYPES")
entwine = Entwine(
    Branch00=crv_6,
    Branch01=crv_7,
    Branch02=crv,
    Branch03=crv_8,
    Branch04=crv_2,
    Branch05=crv_9,
    Branch06=crv_3,
    Branch07=crv_10,
    Branch08=crv_11,
    Branch09=crv_12,
    Branch010=crv_4,
    Branch011=crv_5,
    Branch012=crv_13,
    Branch013=crv_14,
    Branch014=crv_15,
    Branch015=crv_16,
    Branch016=mesh,
    Branch017=mesh_5,
    Branch018=mesh_6,
    Branch019=mesh_2,
    Branch020=mesh_7,
    Branch021=mesh_8,
    Branch022=crv_17,
    Branch023=crv_18,
    Branch024=mesh_9,
    Branch025=mesh_3,
    Branch026=geo,
    Branch027=mesh_4,
    Branch028=geo_2,
    Branch029=mesh_10,
    FlattenInputs=True)  # -> simplify(Result)
unit_cell_selector = ClusterInput()
branch = TreeBranch(Tree=entwine, Path=unit_cell_selector, MaintainPaths=True)
unit_cell = ClusterOutput(branch)  # Single unit cell to populate voxels
