# Grasshopper definition silos.gh (Grasshopper 1.0.7)
# plug-ins: FEM-Design, Kangaroo2 Components, BH.UI.Grasshopper

neg = Negative(Value=Slider(3.7, range=0..10))
series = Series(Start=0, Step=1, Count=10)
polygon = Polygon(Plane=PlaneXY(0, 0, 0), Radius=3, Segments=Slider(16, range=2..20), FilletRadius=0)  # -> Polygon, Length
Z = UnitZ(Factor=neg)
Z_2 = UnitZ(Factor=series)
move = Move(Geometry=polygon.Polygon, Motion=Z)  # -> Geometry, Transform
move_2 = Move(Geometry=polygon.Polygon, Motion=Z_2)  # -> Geometry, Transform
area = Area(Geometry=move.Geometry)  # -> Area, Centroid
explode = Explode(Curve=polygon.Polygon, Recursive=True)  # -> Segments, Vertices
scale = Scale(Geometry=move.Geometry, Center=area.Centroid, Factor=0.5)  # -> Geometry, Transform
loft = Loft(Curves=move_2.Geometry, Options={Adjust=False, Closed=False, LoftEnds=0, LoftSimp=0, LoftType=0, Rebuild=10, Refit=0.01})
item = ListItem(List=move_2.Geometry, Index="-1", Wrap=True)
Z_3 = UnitZ(Factor=Slider(1.7, range=0..10))
duppt = RemoveDuplicatePts(Points=explode.Vertices, Tolerance=0.01)
merge = Merge(Data1=polygon.Polygon, Data2=scale.Geometry)
fcircle = CircleFit(Points=duppt)  # -> Circle, Radius, Deviation
boundary = BoundarySurfaces(Edges=scale.Geometry)
loft_2 = Loft(Curves=merge, Options={Adjust=False, Closed=False, LoftEnds=0, LoftSimp=0, LoftType=0, Rebuild=10, Refit=0.01})
move_3 = Move(Geometry=item, Motion=Z_3)  # -> Geometry, Transform
range = Range(Domain=Domain(0, 1), Steps=Slider(3, range=3..10))
area_2 = Area(Geometry=move_3.Geometry)  # -> Area, Centroid
eval = EvaluateCurve(Curve=reparameterize(fcircle.Circle), Parameter=range)  # -> Point, Tangent, Angle
scale_2 = Scale(Geometry=move_3.Geometry, Center=area_2.Centroid, Factor=0.5)  # -> Geometry, Transform
merge_2 = Merge(Data1=item, Data2=scale_2.Geometry)
crv_cp = CurveClosestPoint(Point=eval.Point, Curve=polygon.Polygon)  # -> Point, Parameter, Distance
merge_3 = Merge(Data1=loft_2, Data2=loft)  # -> flatten(Result)
Z_4 = UnitZ(Factor=1)
loft_3 = Loft(Curves=merge_2, Options={Adjust=False, Closed=False, LoftEnds=0, LoftSimp=0, LoftType=0, Rebuild=10, Refit=0.01})
boundary_2 = BoundarySurfaces(Edges=scale_2.Geometry)
merge_4 = Merge(Data1=boundary, Data2=loft_2, Data3=loft, Data4=boundary_2, Data5=loft_3)
join = BrepJoin(Breps=merge_3)  # -> Breps, Closed
line = LineSDL(Start=crv_cp.Point, Direction=Z_4, Length="-10")
materialdatabase = MaterialDatabase(CountryCode="S")  # -> SteelMaterial, ConcreteMaterial, TimberMaterial, ReinforcementMaterial, StratumMaterial, CustomMaterial
sectiondatabase = SectionDatabase()  # -> SteelSection, ConcreteSection, TimberSection, HollowCoreSection, CustomSection
materialdatabase_2 = MaterialDatabase(CountryCode="S")  # -> SteelMaterial, ConcreteMaterial, TimberMaterial, ReinforcementMaterial, StratumMaterial, CustomMaterial
flip = FlipCurve(Curve=line)  # -> Curve, Flag
end = EndPoints(Curve=flip.Curve)  # -> Start, End
debrep = DeconstructBrep(Brep=join.Breps)  # -> Faces, Edges, flatten(Vertices)
debrep_2 = DeconstructBrep(Brep=merge_4)  # -> Faces, Edges, Vertices
md_slider = MDSlider(SliderMode=0, slider_value=Point(0.5, 0.5, 0.5), x_domain=Domain(0, 1), y_domain=Domain(0, 1), z_domain=Domain(0, 1))
item_2 = ListItem(List=materialdatabase.SteelMaterial, Index=0, Wrap=True)
construct = LoadCaseConstruct(Name="Pressure", Type="Ordinary", DurationClass="permanent")
rigid = PointSupportRigid(PointPlane=end.Start, Identifier="S")
item_3 = ListItem(List=materialdatabase_2.ConcreteMaterial, Index=0, Wrap=True)
evalsrf = EvaluateSurface(Surface=debrep.Faces, Point=md_slider)  # -> Point, Normal, UDirection, VDirection, Frame
item_4 = ListItem(List=sectiondatabase.SteelSection, Index="65", Wrap=True)
panel = Panel(sectiondatabase.SteelSection)
construct_2 = Plate(Surface=debrep_2.Faces, Thickness="0.25", Material=item_3, Identifier="P")  # -> flatten(Slab)
column = BarsColumn(Line=flip.Curve, Material=item_2, Section=item_4, OrientLCS=True, Identifier="C")
pdecon = Deconstruct(Point=debrep.Vertices)  # -> XComponent, YComponent, ZComponent
bnd = Bounds(Numbers=pdecon.ZComponent)
range_2 = Range(Domain=bnd, Steps=10)
vec = VectorXYZ(XComponent=0, YComponent=0, ZComponent=range_2)  # -> Vector, Length
xy = XYPlane(Origin=vec.Vector)
sec = BrepPlane(Brep=graft(debrep_2.Faces), Plane=xy)  # -> simplify(Curves), Points
clean = CleanTree(RemoveNulls=True, RemoveInvalid=True, RemoveEmpty=invert(False), Tree=sec.Curves)  # -> flatten(Tree)
explode_2 = Explode(Curve=clean, Recursive=True)  # -> flatten(Segments), Vertices
dupln = RemoveDuplicateLines(Lines=explode_2.Segments, Tolerance=0.01)
dedomain = DeconstructDomain(Domain=bnd)  # -> Start, End
construct_3 = LoadCombinationConstruct(Name="ULS", Type="ultimate_ordinary", LoadCase=construct, Gamma="1.0")
join_2 = JoinCurves(Curves=dupln, Preserve=False)
construct_4 = PressureLoadConstruct(Surface=debrep.Faces, LoadDirection=evalsrf.Normal, LoadCase=construct, Z0=dedomain.End, Q0="0.0", Qh="1")
area_3 = Area(Geometry=join_2)  # -> Area, Centroid
materialdatabase_3 = MaterialDatabase(CountryCode="S")  # -> SteelMaterial, ConcreteMaterial, TimberMaterial, ReinforcementMaterial, StratumMaterial, CustomMaterial
sectiondatabase_2 = SectionDatabase()  # -> SteelSection, ConcreteSection, TimberSection, HollowCoreSection, CustomSection
pdecon_2 = Deconstruct(Point=area_3.Centroid)  # -> XComponent, YComponent, ZComponent
sort = SortList(Keys=pdecon_2.ZComponent, ValuesA=join_2)  # -> Keys, ValuesA
split = SplitList(List=sort.ValuesA, Index="1")  # -> ListA, ListB
item_5 = ListItem(List=sectiondatabase_2.SteelSection, Index=0, Wrap=True)
item_6 = ListItem(List=materialdatabase_3.SteelMaterial, Index=0, Wrap=True)
crv = Curve(split.ListB)
explode_3 = Explode(Curve=crv, Recursive=True)  # -> Segments, Vertices
connection = FEMDesignConnection(DeleteOutputFolder=False)
beam = BarsBeam(Curve=explode_3.Segments, Material=item_6, Section=item_5, OrientLCS=True, Identifier="B")  # -> flatten(Bar)
construct_5 = ModelConstruct(
    CountryCode="S",
    StructureElements=flatten([construct_2, column, rigid, beam]),
    Loads=flatten(construct_4),
    LoadCases=construct,
    LoadCombinations=construct_3)
stability = StabilityDefine(LoadCombination="ULS", NumShapes="3", PositiveOnly=False, NumIterations=20)
openmodel = FEMDesignOpenModel(Connection=connection, Model=construct_5, RunNode=True)  # -> Connection, Model, Success
toggle = BooleanToggle(True)
analysis = AnalysisDefine(
    Stability=stability,
    CalcCase=toggle,
    CalcCstage=False,
    CalcImpf=False,
    CalcComb=toggle,
    CalcGmax=False,
    CalcStab=Toggle(True),
    CalcFreq=False,
    CalcSeis=False,
    CalcDesign=False,
    CalcFootfall=False,
    Elemfine=True,
    Diaphragm=False,
    PeakSmoothing=False)
runanalysis = FEMDesignRunAnalysis(Connection=openmodel.Connection, Analysis=analysis, RunNode=True)  # -> Connection, Log, Success
resultstype = ResultsType({"NodalDisplacement", "NodalDisplacement", "PointSupportReaction", "PointSupportReactionMinMax", "PointConnectionForce", "BarDisplacement", "BarInternalForce", "BarStress", "LineSupportReaction", "LineConnectionResultant"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}, selected="ShellDisplacement")
resultstype_2 = ResultsType({"NodalDisplacement", "NodalDisplacement", "PointSupportReaction", "PointSupportReactionMinMax", "PointConnectionForce", "BarDisplacement", "BarInternalForce", "BarStress", "LineSupportReaction", "LineConnectionResultant"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}, selected="NodalDisplacement")
option = ResultOption(Bar="ByStep", Surface="Vertices", Step=0.5)
getcasecombresults = FEMDesignGetCaseCombResults(Connection=runanalysis.Connection, ResultType=resultstype, RunNode=True)  # -> Connection, Results, Success
stabilityresults = FEMDesignGetStabilityResults(Connection=runanalysis.Connection, RunNode=True)  # -> Connection, BucklingShapes, CriticalParameter, Success
getcasecombresults_2 = FEMDesignGetCaseCombResults(Connection=runanalysis.Connection, ResultType=resultstype_2, RunNode=True)  # -> Connection, Results, Success
getfemodel = FEMDesignGetFeModel(Connection=stabilityresults.Connection, RunNode=True)  # -> Connection, FiniteElement, Success
imperfectioncritical = ImperfectionCritical(Result=stabilityresults.CriticalParameter, CaseCombinationName="ULS")  # -> CaseIdentifier, Shape, CriticalParam, Amplitude
nodaldisplacement = NodalDisplacement(Result=getcasecombresults_2.Results, CaseCombinationName="ULS")  # -> CaseIdentifier, NodeId, Translation, Rotation
resultstype_3 = ResultsType({"NodalDisplacement", "NodalDisplacement", "PointSupportReaction", "PointSupportReactionMinMax", "PointConnectionForce", "BarDisplacement", "BarInternalForce", "BarStress", "LineSupportReaction", "LineConnectionResultant"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}, selected="NodalDisplacement")
shelldisplacement = ShellDisplacement(Result=getcasecombresults.Results, CaseCombinationName="ULS")  # -> CaseIdentifier, ElementId, NodeId, Translation, Rotation
femnode = FiniteElementFemNode()  # -> NodeId, Point
explode_4 = Explode(Object=getcasecombresults_2.Results, Component="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")  # -> Id, NodeId, Ex, Ey, Ez, Fix, Fiy, Fiz, CaseIdentifier
sort_2 = SortList(Keys=nodaldisplacement.NodeId)  # -> Keys, ValuesA
femshell = FiniteElementFemShell(FiniteElement=getfemodel.FiniteElement)  # -> Identifier, ElementId, FaceIndex, MeshGeometry
fembar = FiniteElementFemBar(FiniteElement=getfemodel.FiniteElement)  # -> Identifier, ElementId, NodeI, NodeJ, LineGeometry
