# Grasshopper definition ReinfFologram.gh (Grasshopper 1.0.7)
# plug-ins: FEM-Design, treesloth01, Fologram For Grasshopper Utilities, Alpaca4d, Pufferfish, FologramForGrasshopper

materialdatabase = MaterialDatabase(CountryCode="S")  # -> SteelMaterial, ConcreteMaterial, TimberMaterial, ReinforcementMaterial, StratumMaterial, CustomMaterial
item = ListItem(List=materialdatabase.ConcreteMaterial, Index=0, Wrap=True)
item_2 = ListItem(List=materialdatabase.ReinforcementMaterial, Index=0, Wrap=True)
define = WireDefine(Diameter="0.012", Material=item_2, Profile="ribbed")

crv = Curve(<curve referenced from the Rhino model>)
panel = Panel("""x
y""")
panel_2 = Panel("""x
y""")
panel_3 = Panel("""top
bottom""")
panel_4 = Panel("""top
bottom""")
graft = GraftTree(Tree=panel, IncludeEmptyLists=True, IncludeNullItems=True)
graft_2 = GraftTree(Tree=panel_2, IncludeEmptyLists=True, IncludeNullItems=True)
crv_2 = Curve([<curve referenced from the Rhino model> x4])
item_3 = ListItem(List=materialdatabase.ReinforcementMaterial, Index=0, Wrap=True)
crv_3 = Curve(crv)
reinforcementlayout = SurfaceReinforcementLayout(Direction=graft, Space="0.15", Face=panel_3, Cover=0.02)  # -> flatten(Straight)
reinforcementlayout_2 = SurfaceReinforcementLayout(Direction=graft_2, Space="0.30", Face=panel_4, Cover=0.02)  # -> flatten(Straight)
graft_3 = GraftTree(Tree=crv_2, IncludeEmptyLists=True, IncludeNullItems=True)
graft_4 = GraftTree(Tree=crv_3, IncludeEmptyLists=True, IncludeNullItems=True)
define_2 = WireDefine(Diameter="0.008", Material=item_3, Profile="ribbed")
construct = Plate(Surface=crv, Thickness="0.30", Material=item, Identifier="P")
bysurface = SurfaceReinforcementBySurface(Surface=graft_4, Straight=reinforcementlayout_2, Wire=define_2)  # -> flatten(SurfaceReinforcement)
bysurface_2 = SurfaceReinforcementBySurface(Surface=graft_3, Straight=reinforcementlayout, Wire=define)  # -> flatten(SurfaceReinforcement)
addtoslab = SurfaceReinforcementAddToSlab(Slab=construct, SurfaceReinforcement=flatten([bysurface_2, bysurface]))
construct_2 = ModelConstruct(CountryCode="S", StructureElements=addtoslab)
connection = FEMDesignConnection(DeleteOutputFolder=False)
openmodel = FEMDesignOpenModel(Connection=connection, Model=construct_2, RunNode=True)  # -> Connection, Model, Success
designgroup = DesignGroupDefine()
deconstruct = ModelDeconstruct(Model=openmodel.Model)  # -> CountryCode, Foundations, Bars, FictitiousBars, Shells, FictitiousShells, Diaphragms, LabelledSection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
deconstruct_2 = ShellDeconstruct(Shell=deconstruct.Shells)  # -> Guid, Surface, ThicknessItems, Material, ShellEccentricity, ShellOrthotropy, EdgeCurves, EdgeConnections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
deconstruct_3 = ThicknessDeconstruct(ThicknessLocationValue=deconstruct_2.ThicknessItems)  # -> Point, Value
division = Division(A=deconstruct_3.Value, B=2)
neg = Negative(Value=division)
deconstruct_4 = SurfaceReinforcementDeconstruct(SurfaceReinforcement=deconstruct_2.SurfaceReinforcement)  # -> Guid, Surface, Straight, Wire
merge = Merge(Data1=division, Data2=neg)
offset = OffsetSurface(Surface=deconstruct_2.Surface, Distance=merge, Retrim=True)
deconstruct_5 = WireDeconstruct(Wire=deconstruct_4.Wire)  # -> Diameter, ReinforcingMaterial, Profile
edges = BrepEdges(Brep=offset)  # -> Naked, Interior, NonManifold
deconstruct_6 = StraightDeconstruct(Straight=deconstruct_4.Straight)  # -> Direction, Space, Face, Cover
flip = FlipMatrix(Data=edges.Naked)
loft = Loft(Curves=flip, Options={Adjust=False, Closed=False, LoftEnds=0, LoftSimp=0, LoftType=0, Rebuild=10, Refit=0.01})
python = GhPythonScript(x=deconstruct_6.Direction)  # -> out, a
# ---------- python: Python ----------
__author__ = "Marco"
__version__ = "2023.07.28"

import rhinoscriptsyntax as rs
import Rhino.Geometry as rg

if x == "X":
    a = rg.Vector3d(1,0,0)
elif x == "Y":
    a = rg.Vector3d(0,1,0)
# ---------- end python ----------
join = BrepJoin(Breps=flatten([loft, offset]))  # -> Breps, Closed
division_2 = Division(A=deconstruct_3.Value, B=2)
contour = Contour(Shape=deconstruct_4.Surface, Point=Point(0, 0, 0), Direction=python.a, Distance=deconstruct_6.Space)
python_2 = GhPythonScript(thickness=division_2, face=deconstruct_6.Face, cover=deconstruct_6.Cover)  # -> out, a
# ---------- python_2: Python ----------
__author__ = "Marco"
__version__ = "2023.07.28"

import rhinoscriptsyntax as rs
import Rhino.Geometry as rg

if face == "Top":
    a = thickness - cover
elif face == "Bottom":
    a = -thickness + cover
# ---------- end python_2 ----------
shift = ShiftPaths(Data=simplify(contour), Offset=-1)
Z = UnitZ(Factor=python_2.a)
graft_5 = GraftTree(Tree=Z, IncludeEmptyLists=True, IncludeNullItems=True)
graft_6 = GraftTree(Tree=deconstruct_5.Diameter, IncludeEmptyLists=True, IncludeNullItems=True)
move = Move(Geometry=shift, Motion=graft_5)  # -> Geometry, Transform
mpipe = MeshPipe(Polylines=move.Geometry, NumberOfSides="6", Tolerance=0.1, Radius=graft_6, Cap=False, Join=False)
tstat = TreeStatistics(Tree=mpipe)  # -> Paths, Length, Count
clr = ColorsAlpaca4d(GradientIndex=11)
range = Range(Domain=Domain(0, 1), Steps=expr("x-1", tstat.Count))
twnthrucols = TweenThroughColors(
    Colors=clr,
    Factor=range,
    Normalized=True,
    Equalized=False,
    Weighted=False,
    Loopback=False,
    Degree=3,
    InterpolationType=0,
    Alpha=True)
graft_7 = GraftTree(Tree=twnthrucols, IncludeEmptyLists=True, IncludeNullItems=True)
material = CreateMaterial(Diffuse=graft_7, Specular=RGB(255, 255, 255), Emission=RGB(0, 0, 0), Transparency=0, Shine=0)
sync = SyncObject(
    GM=join.Breps,
    AlwaysIncludeTextureCoordinates=False,
    Clickable=False,
    DefaultCurveThicknessMillimeters=2.5,
    DefaultGlossPercent=0,
    DefaultMaterialColor=RGBA(255, 255, 255, 147),
    DefaultSpecularPercent=0,
    Grabbable=False,
    Interactive=False,
    Occlusion=False,
    Outline=False,
    hasSerializedData=True)
sync_2 = SyncObject(
    GM=mpipe,
    AlwaysIncludeTextureCoordinates=False,
    Clickable=False,
    DefaultCurveThicknessMillimeters=2.5,
    DefaultGlossPercent=0,
    DefaultMaterialColor=RGB(255, 255, 255),
    DefaultSpecularPercent=0,
    Grabbable=False,
    Interactive=False,
    Occlusion=False,
    Outline=False,
    hasSerializedData=True)
syncmat = SyncMaterial(Material=ColourSwatch(SwatchColor=RGBA(227, 227, 227, 103)), hasSerializedData=True)
syncmat_2 = SyncMaterial(Material=material, hasSerializedData=True)
assignmat = AssignMaterial(SynchronizedGeometry=sync, SynchronizedMaterial=syncmat)
assignmat_2 = AssignMaterial(SynchronizedGeometry=sync_2, SynchronizedMaterial=syncmat_2)
